# Grasshopper definition Week2.gh (Grasshopper 1.0.8)

dom = ConstructDomain(DomainStart=Slider(5, range=-9..11), DomainEnd=Slider(20, range=-9..20))
range = Range(Domain=dom, Steps=expr("x-1", "20"))
series = Series(Start="5", Step="5", Count="20")
item = ListItem(List=range, Index="0", Wrap=True)  # -> Item, Item1
panel = Panel(range)
short = ShortestList(ListA=series, ListB=range, TrimMode=2)  # -> ListA, ListB
subtraction = Subtraction(A=item.Item1, B=item.Item)
pt = ConstructPoint(XCoordinate=short.ListA, YCoordinate=0, ZCoordinate=short.ListB)
Z = UnitZ(Factor=subtraction)
panel_2 = Panel("""0
1""")
move = Move(Geometry=pt, Motion=Z)  # -> Geometry, Transform
panel_3 = Panel(Z)
weave = Weave(Pattern=panel_2, Stream0=pt, Stream1=move.Geometry, NullGaps=False)
panel_4 = Panel(subtraction)
panel_5 = Panel("""-1
-2""")
points = PointList(Points=weave)
cull_i = CullIndex(List=weave, Indices=panel_5, Wrap=True)
order = PointOrder(Points=weave)
pline = PolyLine(Vertices=cull_i, Closed=False)
bbox = BoundingBox(Content=flatten(cull_i), Plane=PlaneXY(0, 0, 0))  # -> Box, Box_2
debox = DeconstructBox(Box=bbox.Box)  # -> Plane, X, Y, Z
explode = Explode(Curve=pline, Recursive=True)  # -> Segments, Vertices
panel_6 = Panel(bbox.Box)
Z_2 = UnitZ(Factor=Slider(20, range=0..100))
crv = Curve(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)
Z_3 = UnitZ(Factor=Slider(20, range=0..100))
srf = Surface(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)
crv_2 = Curve(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)
planesrf = PlaneSurface(Plane=debox.Plane, XSize=debox.X, YSize=debox.Z)
md_slider = MDSlider(
    SliderMode=0,
    slider_value=Point(0.4909630752, 0.535612525, 0.5),
    x_domain=Domain(0, 1),
    y_domain=Domain(0, 1),
    z_domain=Domain(0, 1))
srf_cp = SurfaceClosestPoint(Point=cull_i, Surface=reparameterize(srf))  # -> Point, UVPoint, Distance
srf_cp_2 = SurfaceClosestPoint(Surface=reparameterize(planesrf))  # -> Point, UVPoint, Distance
panel_7 = Panel(planesrf)
extr = Extrude(Base=crv_2, Direction=Z_2)
extr_2 = Extrude(Base=crv, Direction=Z_3)
pdecon = Deconstruct(Point=srf_cp.UVPoint)  # -> XComponent, YComponent, ZComponent
panel_8 = Panel(md_slider)
evalsrf = EvaluateSurface(Surface=reparameterize(extr_2), Point=srf_cp.UVPoint)  # -> Point, Normal, UDirection, VDirection, Frame
evalsrf_2 = EvaluateSurface(Surface=reparameterize(extr), Point=srf_cp.UVPoint)  # -> Point, Normal, UDirection, VDirection, Frame
subtraction_2 = Subtraction(A="1", B=pdecon.YComponent)
pline_2 = PolyLine(Vertices=evalsrf_2.Point, Closed=False)
pline_3 = PolyLine(Vertices=evalsrf.Point, Closed=False)
loft = Loft(
    Curves=[pline_3, pline_2],
    Options={Adjust=False, Closed=False, LoftEnds=0, LoftSimp=0, LoftType=0, Rebuild=10, Refit=0.01})
radius = Slider(872, range=0..10000)
number_slider = Slider(2177, range=0..10000)
pt_2 = ConstructPoint(XCoordinate=radius, YCoordinate=0, ZCoordinate=0)
division = Division(A=number_slider, B=Slider(20, range=0..100))
dom_2 = ConstructDomain(DomainStart=Slider(5.721, range=0..10), DomainEnd=number_slider)
xy = XYPlane(Origin=Point(0, 0, 0))
circle = CircleCNR(Center=pt_2, Normal=Vector(0, 0, 1), Radius=1)
range_2 = Range(Domain=dom_2, Steps=10)
rotate = Rotate(Geometry=pt_2, Angle=degrees(range_2), Plane=xy)  # -> Geometry, Transform
point = Point([<point referenced from the Rhino model> x9])
Z_4 = UnitZ(Factor=range_2)

repeat = RepeatData(Data=Slider(300, range=0..1000), Length=Slider(10, range=0..10))
merge = Merge(Data1=flatten(repeat), Data2=flatten(Slider(1000, range=0..1000)))
ma = MassAddition(Input=merge)  # -> Result, PartialResults
panel_9 = Panel(ma.PartialResults)

sort_points = SortPoints(Points=point)  # -> Points, Indices
move_2 = Move(Geometry=rotate.Geometry, Motion=Z_4)  # -> Geometry, Transform
polyline = PolyLine(Vertices=sort_points.Points, Closed=False)
intcrv = Interpolate(Vertices=move_2.Geometry, Degree=3, Periodic=False, KnotStyle=1)  # -> Curve, Length, Domain
rebuild_curve = RebuildCurve(Curve=polyline, Count=10, Tangents=False)
len = Length(Curve=intcrv.Curve)
division_2 = Division(A=ma.PartialResults, B=len)
shatter = Shatter(Curve=reparameterize(intcrv.Curve), Parameters=division_2)
