# Grasshopper definition week2 2.gh (Grasshopper 1.0.8)
# plug-ins: RhinoCodePluginGH

number_slider = Slider(10, range=0..10)
crv = Curve(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)
crv_2 = Curve(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)
ipy2 = IronPython2Script(topFlange=crv, bottomFlange=crv_2)  # -> out, trussWebs; inputs topFlange: Curve, bottomFlange: Curve
# ---------- ipy2: IronPython ----------
import ghpythonlib.components as ghc
#Point A
trussDivision = 10

#Point B
topPoints = ghc.DivideCurve(topFlange,trussDivision, False)
bottomPoints = ghc.DivideCurve(bottomFlange,trussDivision, False)

#Point C
topPoints = ghc.Dispatch(topPoints["points"],[False, True])
bottomPoints = ghc.Dispatch(bottomPoints["points"],[False, True])
#print(topPoints)

#Point D
trussPoints = ghc.Weave([1,0],topPoints["list_a"],bottomPoints["list_b"])
print(trussPoints)

trussWebs = ghc.PolyLine(trussPoints, False)
# ---------- end ipy2 ----------
divide = DivideCurve(Curve=crv, Count=number_slider, Kinks=False)  # -> Points, Tangents, Parameters
divide_2 = DivideCurve(Curve=crv_2, Count=number_slider, Kinks=False)  # -> Points, Tangents, Parameters
panel = Panel("""0
1""")
crv_3 = Curve(ipy2.trussWebs)
panel_2 = Panel(ipy2.trussWebs)
dispatch = Dispatch(List=divide.Points, DispatchPattern=panel)  # -> ListA, ListB
dispatch_2 = Dispatch(List=divide_2.Points, DispatchPattern=panel)  # -> ListA, ListB
pt = Point(dispatch.ListA)
pt_2 = Point(dispatch_2.ListB)
weave = Weave(Pattern=[0, 1], Stream0=pt_2, Stream1=pt, NullGaps=False)
weave_2 = Weave(Pattern=panel, Stream0=pt_2, Stream1=pt, NullGaps=False)
pline = PolyLine(Vertices=weave, Closed=False)
pline_2 = PolyLine(Vertices=weave_2, Closed=False)
