# Grasshopper definition cubic tower.gh (Grasshopper 1.0.8)
# plug-ins: Weaverbird

curve = Curve(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)
geometry = Geometry(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)
geometry_2 = Geometry(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)
number_slider = Slider(140, range=0..1000)
bounding_box = BoundingBox(Content=geometry_2, Plane=PlaneXY(0, 0, 0))  # -> Box, Box_2
bounding_box_2 = BoundingBox(Content=geometry, Plane=PlaneXY(0, 0, 0))  # -> Box, Box_2
number_slider_2 = Slider(200, range=0..1000)
rectangle = Rectangle(Plane=PlaneXY(0, 0, 0), XSize=number_slider, YSize=number_slider, Radius=0)  # -> Rectangle, Length
deconstruct_brep = DeconstructBrep(Brep=bounding_box_2.Box)  # -> Faces, Edges, Vertices
deconstruct_brep_2 = DeconstructBrep(Brep=bounding_box.Box)  # -> Faces, Edges, Vertices
unit_z = UnitZ(Factor=Slider(800, range=0..1000))
extrude = Extrude(Base=rectangle.Rectangle, Direction=unit_z)
unit_x = UnitX(Factor=Slider(10000, range=0..10000))
rectangle_2 = Rectangle(Plane=PlaneXY(0, 0, 0), XSize=number_slider_2, YSize=number_slider_2, Radius=0)  # -> Rectangle, Length
list_item = ListItem(List=deconstruct_brep_2.Faces, Index=Slider(1, range=0..5), Wrap=True)
list_item_2 = ListItem(List=deconstruct_brep.Faces, Index=Slider(1, range=0..5), Wrap=True)
move = Move(Geometry=rectangle_2.Rectangle, Motion=unit_x)  # -> Geometry, Transform
number_slider_3 = Slider(500, range=0..1000)
populate_3d = Populate3D(Region=extrude, Count=Slider(600, range=0..1000), Seed=Slider(2, range=0..10))
rectangular = Rectangular(Plane=move.Geometry, SizeX=number_slider_3, SizeY=number_slider_3, ExtentX=10, ExtentY=5)  # -> Cells, Points
octree = OcTree(Points=populate_3d, Square=Toggle(True), Group=Slider(1, range=0..1))  # -> Boxes, Points
list_item_3 = ListItem(List=deconstruct_brep_2.Vertices, Index=Slider(9, range=0..10), Wrap=True)
list_item_4 = ListItem(List=deconstruct_brep.Vertices, Index=Slider(0, range=0..10), Wrap=True)
box = Box(octree.Boxes)
modular_size = Slider(1500, range=0..10000)
center_box = CenterBox(Base=list_item_3, X=modular_size, Y=modular_size, Z=modular_size)
geometry_3 = Geometry(graft(rectangular.Points))
series = Series(Start=0, Step=Slider(500, range=0..1000), Count=Slider(10, range=0..10))
simple_mesh = SimpleMesh(Brep=octree.Boxes)
line = Line(StartPoint=list_item_3, EndPoint=list_item_4)
weaverbird_s_picture_frame = WeaverbirdsPictureFrame(MeshPolylines=simple_mesh, Distance=5, InsetType=0)
number_slider_4 = Slider(2, range=0..10)
unit_z_2 = UnitZ(Factor=series)
move_2 = Move(Geometry=geometry_3, Motion=unit_z_2)  # -> flatten(Geometry), Transform
octree_2 = OcTree(Points=populate_3d, Square=Toggle(True), Group=Slider(1, range=0..1))  # -> Boxes, Points
divide_length = DivideLength(Curve=line, Length=modular_size)  # -> Points, Tangents, Parameters
volume = Volume(Geometry=box)  # -> Volume, Centroid
weaverbird_s_constant_quads_split_subdiv = WeaverbirdsConstantQuadsSplitSubdivision(MeshCurves=weaverbird_s_picture_frame, Level=number_slider_4, SmoothNakedEdges=1)
scale = Scale(Geometry=box, Center=volume.Centroid, Factor=Slider(0.97, range=0..1))  # -> Geometry, Transform
list_length = ListLength(List=divide_length.Points)
weaverbird_s_catmull_clark_subdivision = WeaverbirdsCatmullClarkSubdivision(MeshCurves=weaverbird_s_constant_quads_split_subdiv, Level=number_slider_4, SmoothNakedEdges=1)
number_slider_5 = Slider(2, range=0..10)
simple_mesh_2 = SimpleMesh(Brep=scale.Geometry)
negative = Negative(Value=Slider(0.5, range=0..1))
octree_3 = OcTree(Points=move_2.Geometry, Square=Toggle(True), Group=Slider(1, range=0..10))  # -> Boxes, Points
box_array = BoxArray(Geometry=list_item_3, Cell=center_box, XCount=list_length, YCount=list_length, ZCount=list_length)  # -> Geometry, Transform
weaverbird_s_constant_quads_split_subdiv_2 = WeaverbirdsConstantQuadsSplitSubdivision(MeshCurves=simple_mesh_2, Level=number_slider_5, SmoothNakedEdges=1)
area = Area(Geometry=octree_3.Boxes)  # -> Area, Centroid
weaverbird_s_catmull_clark_subdivision_2 = WeaverbirdsCatmullClarkSubdivision(MeshCurves=weaverbird_s_constant_quads_split_subdiv_2, Level=number_slider_5, SmoothNakedEdges=1)  # -> flatten(OutputMeshCurves)
curve_2 = Curve(<curve referenced from the Rhino model>)
curve_closest_point = CurveClosestPoint(Point=area.Centroid, Curve=curve_2)  # -> Point, Parameter, Distance
jitter = Jitter(List=weaverbird_s_catmull_clark_subdivision_2, Jitter=Slider(0.6, range=0..1), Seed=2)  # -> Values, Indices
split_list = SplitList(List=jitter.Values, Index=Slider(125, range=0..1000))  # -> ListA, ListB

# ---- group: Bake these
weaverbird_s_mesh_thicken = WeaverbirdsMeshThicken(MeshCurves=weaverbird_s_catmull_clark_subdivision, Distance=negative, OffsetType=0)
mesh = Mesh(split_list.ListB)
