# Grasshopper definition stairs trying 2.gh (Grasshopper 1.0.8)

crv = Curve(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)
crv_2 = Curve(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)
curvepoint = PointOnCurve(crv, parameter=0)
loft = Loft(Curves=[crv, crv_2], Options={Adjust=False, Closed=False, LoftEnds=0, LoftSimp=0, LoftType=0, Rebuild=10, Refit=0.01})
X = UnitX(Factor=1)
step_distance = Slider(0.8, range=0..10)
contour = Contour(Shape=loft, Point=curvepoint, Direction=X, Distance=step_distance)  # -> flatten(Contours)
contour_2 = Contour(Shape=loft, Point=curvepoint, Direction=X, Distance=step_distance)  # -> simplify(Contours)
yz = YZPlane(Origin=Point(0, 0, 0))
cull_i = CullIndex(List=contour, Indices="-1", Wrap=True)  # -> simplify(graft(List))
Z = UnitZ(Factor=1)
offset = OffsetCurve(Curve=cull_i, Distance=expr("-x", Slider(1.3, range=0..10)), Plane=yz, Corners=1)  # -> simplify(Curve)
offset_2 = OffsetCurve(Curve=contour_2, Distance=expr("-x", Slider(0.9, range=0..10)), Plane=Z, Corners=1)  # -> simplify(Curve)
pframe = PerpFrame(Curve=contour_2, Parameter=0)
loft_2 = Loft(
    Curves=[offset_2, contour_2],
    Options={Adjust=False, Closed=False, LoftEnds=0, LoftSimp=0, LoftType=0, Rebuild=10, Refit=0.01})
Z_2 = UnitZ(Factor=step_distance)
loft_3 = Loft(
    Curves=[cull_i, offset],
    Options={Adjust=False, Closed=False, LoftEnds=0, LoftSimp=0, LoftType=0, Rebuild=10, Refit=0.01})
X_2 = UnitX(Factor=step_distance)
extr = Extrude(Base=loft_2, Direction=Z_2)
extr_2 = Extrude(Base=loft_3, Direction=X_2)
