# Grasshopper definition twist tower structure.gh (Grasshopper 1.0.8)

number_slider = Slider(18, range=0..100)
number_slider_2 = Slider(3, range=0..10)
polygon = Polygon(
    Plane=PlaneXY(0, 0, 0),
    Radius=Slider(4, range=0..10),
    Segments=Slider(4, range=0..10),
    FilletRadius=Slider(1.999, range=0..10))  # -> Polygon, Length
series = Series(Start=0, Step=Slider(3, range=0..10), Count=number_slider)
range = Range(Domain=Domain(0, 1), Steps=expr("x-1", number_slider))
polygon_2 = Polygon(Plane=PlaneXY(0, 0, 0), Radius=number_slider_2, Segments=Slider(4, range=0..10), FilletRadius=Slider(0.8, range=0..10))  # -> Polygon, Length
Z = UnitZ(Factor=series)
graph = GraphMapper(
    range,
    x0=0,
    x1=1,
    y0=0,
    y1=1,
    container_name="Sine",
    Equation_px=[0.005267750006, 0.6234262586],
    Equation_py=[0.0001664757729, 0.7976781726])
rotate = Rotate(Geometry=polygon_2.Polygon, Angle=degrees(Slider(45, range=0..100)), Plane=PlaneXY(0, 0, 0))  # -> Geometry, Transform
X = UnitX(Factor=Slider(10, range=0..10))
move = Move(Geometry=polygon.Polygon, Motion=Z)  # -> Geometry, Transform
dom = ConstructDomain(DomainStart=Slider(1.395, range=0..10), DomainEnd=Slider(2.269, range=0..10))
bnd = Bounds(Numbers=graph)
move_2 = Move(Geometry=rotate.Geometry, Motion=X)  # -> Geometry, Transform
srf = Surface(move_2.Geometry)
cp = ControlPoints(Curve=move.Geometry)  # -> Points, Weights, Knots
remap = RemapNumbers(Value=graph, Source=bnd, Target=dom)  # -> Mapped, Clipped
scale = Scale(Geometry=polygon.Polygon, Center=Point(0, 0, 0), Factor=0.5)  # -> Geometry, Transform
cpoly = ControlPolygon(Curve=move_2.Geometry)  # -> Polygon, Points
untrim = Untrim(Surface=srf)
area = Area(Geometry=move_2.Geometry)  # -> Area, Centroid
avr = Average(Input=cp.Points)  # -> flatten(ArithmeticMean)
item = ListItem(List=reverse(avr), Index=0, Wrap=True)
pdecon = Deconstruct(Point=item)  # -> XComponent, YComponent, ZComponent
area_2 = Area(Geometry=srf)  # -> Area, Centroid
multiplication = Multiplication(A=Slider(0.2, range=0..1), B=number_slider_2)
multiplication_2 = Multiplication(A=Slider(2, range=0..10), B=multiplication)
crv = Curve(cpoly.Polygon)
Z_2 = UnitZ(Factor=pdecon.ZComponent)
scale_2 = Scale(Geometry=untrim, Center=area_2.Centroid, Factor=Slider(1.1, range=0..10))  # -> Geometry, Transform
Z_3 = UnitZ(Factor=multiplication)
extr = Extrude(Base=scale.Geometry, Direction=Z_2)
Z_4 = UnitZ(Factor=multiplication_2)
scale_nu = ScaleNU(Geometry=move.Geometry, Plane=avr, ScaleX=remap.Mapped, ScaleY=remap.Mapped, ScaleZ=1)  # -> Geometry, Transform
scale_3 = Scale(Geometry=crv, Center=area.Centroid, Factor=Slider(1.1, range=0..10))  # -> Geometry, Transform
extr_2 = Extrude(Base=srf, Direction=Z_4)
extr_3 = Extrude(Base=scale_2.Geometry, Direction=Z_3)
debrep = DeconstructBrep(Brep=scale_2.Geometry)  # -> Faces, Edges, Vertices
series_2 = Series(Start=0, Step=Slider(9.124, range=0..10), Count=number_slider)
boundary = BoundarySurfaces(Edges=scale_3.Geometry)
trim = TrimSolid(Shape=extr_3, Cutters=extr_2)
join = JoinCurves(Curves=debrep.Edges, Preserve=False)
rotate_2 = Rotate(Geometry=scale_nu.Geometry, Angle=degrees(series_2), Plane=avr)  # -> Geometry, Transform
srfsplit = SurfaceSplit(Surface=boundary, Curves=move_2.Geometry)
geo = Geometry(trim)
subtraction = Subtraction(A=number_slider, B="1")
item_2 = ListItem(List=srfsplit, Index=0, Wrap=True)
loft = Loft(
    Curves=rotate_2.Geometry,
    Options={Adjust=False, Closed=False, LoftEnds=0, LoftSimp=0, LoftType=0, Rebuild=10, Refit=0.01})
edges = BrepEdges(Brep=geo)  # -> Naked, Interior, NonManifold
cap = CapHoles(Brep=loft)
multiplication_3 = Multiplication(A=number_slider_2, B=Slider(0.2, range=0..1))
srf_2 = Surface(item_2)
cull_i = CullIndex(List=rotate_2.Geometry, Indices=["0", subtraction], Wrap=True)
crv_2 = Curve(edges.Naked)
Z_5 = UnitZ(Factor=multiplication_3)
boundary_2 = BoundarySurfaces(Edges=cull_i)
neg = Negative(Value=Slider(0.6, range=0..1))
offset = OffsetSurface(Surface=loft, Distance=neg, Retrim=True)
Z_6 = UnitZ(Factor=Slider(0.45, range=0..1))
join_2 = JoinCurves(Curves=crv_2, Preserve=False)
extr_4 = Extrude(Base=srf_2, Direction=Z_5)
divide = DivideDomain²(Domain=offset, UCount=Slider(16.947, range=0..100), VCount=Slider(15, range=0..100))
dom_2 = ConstructDomain(DomainStart=Slider(0.205, range=0..10), DomainEnd=Slider(1.794, range=0..10))
extr_5 = Extrude(Base=boundary_2, Direction=Z_6)
item_3 = ListItem(List=join_2, Index=0, Wrap=True)  # -> Item, Item1
brep = Brep(extr_4)
lng = ListLength(List=divide)
loft_2 = Loft(
    Curves=[item_3.Item, item_3.Item1],
    Options={Adjust=False, Closed=False, LoftEnds=0, LoftSimp=0, LoftType=0, Rebuild=10, Refit=0.01})
random = Random(Range=dom_2, Number=lng, Seed=2)
neg_2 = Negative(Value=random)
bbox = BoundingBox(Content=brep, Plane=PlaneXY(0, 0, 0))  # -> Box, Box_2
sbox = SurfaceBox(Surface=offset, Domain=divide, Height=neg_2)
morph = BoxMorph(Geometry=brep, Reference=bbox.Box, Target=sbox)
