# Grasshopper definition week 3.gh (Grasshopper 1.0.8)

radius = Slider(872, range=0..10000)
number_slider = Slider(2177, range=0..10000)
degrees_for_each_step = Slider(20, range=0..100)
radius_2 = Slider(1052, range=0..10000)
number_slider_2 = Slider(2969, range=0..10000)
pt = ConstructPoint(XCoordinate=radius, YCoordinate=0, ZCoordinate=0)
division = Division(A=number_slider, B=Slider(20, range=0..100))
dom = ConstructDomain(DomainStart=Slider(0, range=0..10), DomainEnd=number_slider)
xy = XYPlane(Origin=Point(0, 0, 0))
circle = CircleCNR(Center=pt, Normal=Vector(0, 0, 1), Radius=1)
range = Range(Domain=dom, Steps=10)
pt_2 = ConstructPoint(XCoordinate=radius_2, YCoordinate=0, ZCoordinate=0)
division_2 = Division(A=number_slider_2, B=degrees_for_each_step)
dom_2 = ConstructDomain(DomainStart=Slider(0, range=0..10), DomainEnd=number_slider_2)
rotate = Rotate(Geometry=pt, Angle=degrees(range), Plane=xy)  # -> Geometry, Transform
Z = UnitZ(Factor=range)
xy_2 = XYPlane(Origin=Point(0, 0, 0))
range_2 = Range(Domain=dom_2, Steps=division_2)
panel = Panel(division_2)
rotate_2 = Rotate(Geometry=pt_2, Angle=degrees(range_2), Plane=xy_2)  # -> Geometry, Transform
move = Move(Geometry=rotate.Geometry, Motion=Z)  # -> Geometry, Transform
Z_2 = UnitZ(Factor=range_2)
intcrv = Interpolate(Vertices=move.Geometry, Degree=3, Periodic=False, KnotStyle=1)  # -> Curve, Length, Domain
move_2 = Move(Geometry=rotate_2.Geometry, Motion=Z_2)  # -> Geometry, Transform
intcrv_2 = Interpolate(Vertices=rotate_2.Geometry, Degree=3, Periodic=False, KnotStyle=1)  # -> Curve, Length, Domain
repeat = RepeatData(Data=Slider(300, range=0..1000), Length=Slider(10, range=0..10))
merge = Merge(Data1=flatten(repeat), Data2=flatten(Slider(1000, range=0..1000)))
repeat_2 = RepeatData(Data=merge, Length=Slider(100, range=0..100))
len = Length(Curve=intcrv_2.Curve)
ma = MassAddition(Input=repeat_2)  # -> Result, PartialResults
panel_2 = Panel(ma.PartialResults)
division_3 = Division(A=ma.PartialResults, B=len)
number_slider_3 = Slider(3.5, range=0..10)
shatter = Shatter(Curve=reparameterize(intcrv_2.Curve), Parameters=division_3)

cull_i = CullIndex(List=shatter, Indices="-1", Wrap=True)
scale = Scale(Geometry=cull_i, Center=Point(0, 0, 0), Factor=number_slider_3)  # -> Geometry, Transform
rulesrf = RuledSurface(CurveA=cull_i, CurveB=scale.Geometry)
lng = ListLength(List=rulesrf)
series = Series(Start="150", Step="150", Count=lng)
Z_3 = UnitZ(Factor=series)
move_3 = Move(Geometry=rulesrf, Motion=Z_3)  # -> Geometry, Transform
panel_3 = Panel(series)

cull_i_2 = CullIndex(List=shatter, Indices=-1, Wrap=True)
scale_2 = Scale(Geometry=cull_i_2, Center=Point(0, 0, 0), Factor=number_slider_3)  # -> Geometry, Transform
rulesrf_2 = RuledSurface(CurveA=cull_i_2, CurveB=scale_2.Geometry)
lng_2 = ListLength(List=rulesrf_2)
series_2 = Series(Start="150", Step="150", Count=lng_2)
Z_4 = UnitZ(Factor=series_2)
move_4 = Move(Geometry=rulesrf_2, Motion=Z_4)  # -> Geometry, Transform
panel_4 = Panel(series_2)
scale_3 = Scale(Geometry=cull_i_2, Center=Point(0, 0, 0), Factor=Slider(1.3, range=0..10))  # -> Geometry, Transform
move_5 = Move(Geometry=cull_i_2, Motion=Vector(0, 0, 10))  # -> Geometry, Transform
geo = Geometry([<brep referenced from the Rhino model> x2])
crv = Curve(move_5.Geometry)
group = Group(Objects=geo)
xy_3 = XYPlane(Origin=Point(0, 0, 0))
hframe = HorizontalFrame(Curve=reparameterize(crv), Parameter=Slider(0.5, range=0..1))
dispatch = Dispatch(List=hframe, DispatchPattern="0")  # -> ListA, ListB
orient = Orient(Geometry=group, Source=xy_3, Target=dispatch.ListB)  # -> Geometry, Transform
