# Grasshopper definition Steel Joist.3dm.gh (Grasshopper 1.0.8)

radius = Slider(150, range=0..1000)
line = Line(Line((0, 0, 0), (2500, 0, 0)))
radius_2 = Slider(150, range=0..1000)
point_on_curve = PointOnCurve(line, parameter=1)
point_on_curve_2 = PointOnCurve(line, parameter=0)
sphere = Sphere(Base=point_on_curve_2, Radius=radius)
sphere_2 = Sphere(Base=point_on_curve, Radius=radius_2)
number_slider = Slider(0.03, range=0..1)
area = Area(Geometry=sphere)  # -> Area, Centroid
number_slider_2 = Slider(0.08, range=0..1)
number_slider_3 = Slider(0.13, range=0..1)
number_slider_4 = Slider(0.165, range=0..1)
length = Length(Curve=line)
subtraction = Subtraction(A="1", B=number_slider)
line_sdl = LineSDL(Start=point_on_curve_2, Direction=line, Length=length)
subtraction_2 = Subtraction(A="1", B=number_slider_2)
subtraction_3 = Subtraction(A="1", B=number_slider_3)
subtraction_4 = Subtraction(A="1", B=number_slider_4)
raidus = Slider(0.015, range=0..0.15)
evaluate_length = EvaluateLength(Curve=line_sdl, Length=[number_slider_3, subtraction_3], Normalized=True)  # -> Point, Tangent, Parameter
evaluate_length_2 = EvaluateLength(Curve=line_sdl, Length=[number_slider, subtraction], Normalized=True)  # -> Point, Tangent, Parameter
evaluate_length_3 = EvaluateLength(Curve=line_sdl, Length=[number_slider_2, subtraction_2], Normalized=True)  # -> Point, Tangent, Parameter
evaluate_length_4 = EvaluateLength(Curve=line_sdl, Length=[number_slider_4, subtraction_4], Normalized=True)  # -> Point, Tangent, Parameter
multiplication = Multiplication(A=raidus, B=length)
multiplication_2 = Multiplication(A=multiplication, B=Slider(1.8, range=1..3))
multiplication_3 = Multiplication(A=multiplication, B=Slider(1.8, range=1..3))
circle_cnr = CircleCNR(Center=evaluate_length_2.Point, Normal=line_sdl, Radius=multiplication)
circle_cnr_2 = CircleCNR(Center=evaluate_length_3.Point, Normal=line_sdl, Radius=multiplication)
circle_cnr_3 = CircleCNR(Center=evaluate_length.Point, Normal=line_sdl, Radius=multiplication_2)
circle_cnr_4 = CircleCNR(Center=evaluate_length_4.Point, Normal=line_sdl, Radius=multiplication_3)
list_item = ListItem(List=circle_cnr, Index=0, Wrap=True)  # -> Item, Item1
list_item_2 = ListItem(List=circle_cnr_2, Index=0, Wrap=True)  # -> Item, Item1
list_item_3 = ListItem(List=circle_cnr_3, Index=0, Wrap=True)  # -> Item, Item1
list_item_4 = ListItem(List=circle_cnr_4, Index=0, Wrap=True)  # -> Item, Item1
loft_options = LoftOptions(Closed=False, Adjust=False, Rebuild=0, Refit=0, Type=3)
loft = Loft(
    Curves=[list_item.Item, list_item_2.Item],
    Options={Adjust=False, Closed=False, LoftEnds=0, LoftSimp=0, LoftType=0, Rebuild=10, Refit=0.01})
loft_2 = Loft(
    Curves=[list_item_2.Item1, list_item.Item1],
    Options={Adjust=False, Closed=False, LoftEnds=0, LoftSimp=0, LoftType=0, Rebuild=10, Refit=0.01})
loft_3 = Loft(Curves=[list_item_2.Item, list_item_3.Item, list_item_3.Item1, list_item_2.Item1], Options=loft_options)
loft_4 = Loft(
    Curves=[list_item_2.Item, list_item_3.Item],
    Options={Adjust=False, Closed=False, LoftEnds=0, LoftSimp=0, LoftType=0, Rebuild=10, Refit=0.01})
loft_5 = Loft(Curves=[list_item_2.Item1, list_item_3.Item1, list_item_4.Item1], Options=loft_options)
loft_6 = Loft(Curves=[list_item_2.Item, list_item_3.Item, list_item_4.Item], Options=loft_options)
loft_7 = Loft(
    Curves=[list_item_2.Item1, list_item_3.Item1],
    Options={Adjust=False, Closed=False, LoftEnds=0, LoftSimp=0, LoftType=0, Rebuild=10, Refit=0.01})
cap_holes = CapHoles(Brep=loft_3)
offset_surface = OffsetSurface(Surface=[loft, loft_2], Distance=Slider(5, range=0..10), Retrim=True)
number_slider_5 = Slider(0.65, range=0..1)
number_slider_6 = Slider(0.55, range=0..1)
area_2 = Area(Geometry=loft_4)  # -> Area, Centroid
area_3 = Area(Geometry=loft_7)  # -> Area, Centroid
cap_holes_2 = CapHoles(Brep=[loft, loft_2])
cap_holes_3 = CapHoles(Brep=offset_surface)
scale_nu = ScaleNU(Geometry=loft_5, Plane=area_3.Centroid, ScaleX=number_slider_6, ScaleY=number_slider_5, ScaleZ=number_slider_5)  # -> Geometry, Transform
scale_nu_2 = ScaleNU(Geometry=loft_6, Plane=area_2.Centroid, ScaleX=number_slider_6, ScaleY=number_slider_5, ScaleZ=number_slider_5)  # -> Geometry, Transform
solid_difference = SolidDifference(BrepsA=cap_holes_2, BrepsB=cap_holes_3)
deconstruct_brep = DeconstructBrep(Brep=scale_nu_2.Geometry)  # -> Faces, Edges, Vertices
deconstruct_brep_2 = DeconstructBrep(Brep=scale_nu.Geometry)  # -> Faces, Edges, Vertices
solid_difference_2 = SolidDifference(BrepsA=solid_difference, BrepsB=[sphere, sphere_2])
list_item_5 = ListItem(List=deconstruct_brep.Edges, Index=1, Wrap=True)  # -> Item, Item1
list_item_6 = ListItem(List=deconstruct_brep_2.Edges, Index=1, Wrap=True)  # -> Item, Item1, Item2, Item3
curve = Curve(flatten(list_item_5.Item))
curve_2 = Curve(flatten(list_item_2.Item))
curve_3 = Curve(flatten(list_item_3.Item))
curve_4 = Curve(flatten(list_item_2.Item1))
curve_5 = Curve(flatten(list_item_3.Item1))
curve_6 = Curve(flatten(list_item_6.Item))
loft_8 = Loft(Curves=[curve_6, curve_5, curve_4], Options=loft_options)
loft_9 = Loft(Curves=[curve, curve_3, curve_2], Options=loft_options)
cap_holes_4 = CapHoles(Brep=[scale_nu_2.Geometry, scale_nu.Geometry])
cap_holes_5 = CapHoles(Brep=[loft_9, loft_8])
solid_difference_3 = SolidDifference(BrepsA=cap_holes_5, BrepsB=cap_holes_4)
