# Grasshopper definition staircase.gh (Grasshopper 1.0.8)

length = Slider(1200, range=0..10000)
width = Slider(380, range=0..1000)
step_thickness = Slider(20, range=0..100)
rectangle = Rectangle(Plane=PlaneXY(0, 0, 0), XSize=length, YSize=width, Radius=0)  # -> Rectangle, Length
fillet_distance = Slider(40, range=0..100)
unit_z = UnitZ(Factor=step_thickness)
fillet_distance_2 = FilletDistance(Curve=rectangle.Rectangle, Distance=fillet_distance)

screw_distance_scale = Slider(3.5, range=1..3.5)
step_thickness_2 = Slider(20, range=0..100)
length_2 = Slider(1200, range=0..10000)
width_2 = Slider(380, range=0..1000)
fillet_distance_3 = Slider(40, range=0..100)
ridge_number = Slider(18, range=0..30)

number_slider = Slider(0.9, range=0..1)
area = Area(Geometry=fillet_distance_2)  # -> Area, Centroid

multiplication = Multiplication(A=step_thickness, B=0.5)
unit_z_2 = UnitZ(Factor=multiplication)
move = Move(Geometry=fillet_distance_2, Motion=unit_z_2)  # -> Geometry, Transform
pipe = Pipe(Curve=move.Geometry, Radius=multiplication, Caps=0)

rectangle_2 = Rectangle(Plane=PlaneXY(0, 0, 0), XSize=length_2, YSize=width_2, Radius=0)  # -> Rectangle, Length
scale_nu = ScaleNU(Geometry=rectangle.Rectangle, Plane=area.Centroid, ScaleX=number_slider, ScaleY=number_slider, ScaleZ=1)  # -> Geometry, Transform
lifted_multiple = Slider(1.3, range=0..2)
unit_z_3 = UnitZ(Factor=step_thickness_2)
fillet_distance_4 = FilletDistance(Curve=rectangle_2.Rectangle, Distance=fillet_distance_3)
fillet_distance_5 = FilletDistance(Curve=scale_nu.Geometry, Distance=fillet_distance)

boundary_surfaces = BoundarySurfaces(Edges=fillet_distance_2)
surface_split = SurfaceSplit(Surface=boundary_surfaces, Curves=fillet_distance_5)
list_item = ListItem(List=surface_split, Index=0, Wrap=True)
extrude = Extrude(Base=list_item, Direction=unit_z)

scale_nu_2 = ScaleNU(
    Geometry=scale_nu.Geometry,
    Plane=area.Centroid,
    ScaleX=Slider(0.95, range=0..1),
    ScaleY=Slider(0.75, range=0..1),
    ScaleZ=1)  # -> Geometry, Transform
multiplication_2 = Multiplication(A=unit_z, B=lifted_multiple)
area_2 = Area(Geometry=fillet_distance_4)  # -> Area, Centroid
multiplication_3 = Multiplication(A=step_thickness_2, B=Slider(0.25, range=0..1))
move_2 = Move(Geometry=scale_nu_2.Geometry, Motion=multiplication_2)  # -> Geometry, Transform

multiplication_4 = Multiplication(A=step_thickness_2, B=0.5)
unit_z_4 = UnitZ(Factor=multiplication_4)
move_3 = Move(Geometry=fillet_distance_4, Motion=unit_z_4)  # -> Geometry, Transform
pipe_2 = Pipe(Curve=move_3.Geometry, Radius=multiplication_3, Caps=0)

scale_nu_3 = ScaleNU(
    Geometry=rectangle_2.Rectangle,
    Plane=area_2.Centroid,
    ScaleX=Slider(0.85, range=0..1),
    ScaleY=Slider(0.88, range=0..1),
    ScaleZ=1)  # -> Geometry, Transform
solid_difference = SolidDifference(BrepsA=pipe, BrepsB=extrude)
lifted_multiple_2 = Slider(1.05, range=0..2)
fillet_distance_6 = FilletDistance(Curve=move_2.Geometry, Distance=fillet_distance)
fillet_distance_7 = FilletDistance(Curve=scale_nu_3.Geometry, Distance=fillet_distance_3)

boundary_surfaces_2 = BoundarySurfaces(Edges=fillet_distance_4)
surface_split_2 = SurfaceSplit(Surface=boundary_surfaces_2, Curves=fillet_distance_7)
list_item_2 = ListItem(List=surface_split_2, Index=0, Wrap=True)
extrude_2 = Extrude(Base=list_item_2, Direction=unit_z_3)

multiplication_5 = Multiplication(A=step_thickness, B=0.7)
offset_curve = OffsetCurve(Curve=move_2.Geometry, Distance=expr("-x", multiplication_5), Corners=1)
populate_2d = Populate2D(Region={Plane=PlaneXY(0, 0, 0), Size=Domain2(u=0..20, v=0..10)}, Count=100, Seed=1)
scale_nu_4 = ScaleNU(
    Geometry=scale_nu_3.Geometry,
    Plane=area_2.Centroid,
    ScaleX=Slider(0.96, range=0..1),
    ScaleY=Slider(0.85, range=0..1),
    ScaleZ=1)  # -> Geometry, Transform
multiplication_6 = Multiplication(A=step_thickness, B=0.3)
multiplication_7 = Multiplication(A=unit_z_3, B=lifted_multiple_2)
pipe_3 = Pipe(Curve=fillet_distance_6, Radius=multiplication_5, Caps=0)
unit_z_5 = UnitZ(Factor=multiplication_6)
offset_curve_2 = OffsetCurve(Curve=offset_curve, Distance=expr("-x", multiplication_5), Corners=1)
move_4 = Move(Geometry=scale_nu_4.Geometry, Motion=multiplication_7)  # -> Geometry, Transform
deconstruct_brep = DeconstructBrep(Brep=extrude_2)  # -> Faces, Edges, Vertices
area_3 = Area(Geometry=pipe_2)  # -> Area, Centroid
move_5 = Move(Geometry=fillet_distance_6, Motion=unit_z_5)  # -> Geometry, Transform
deconstruct_brep_2 = DeconstructBrep(Brep=offset_curve_2)  # -> Faces, Edges, Vertices
multiplication_8 = Multiplication(A=multiplication_6, B=2)
fillet_distance_8 = FilletDistance(Curve=move_4.Geometry, Distance=fillet_distance_3)
unit_z_6 = UnitZ(Factor=multiplication_8)
curve = Curve(deconstruct_brep.Edges)
boundary_surfaces_3 = BoundarySurfaces(Edges=move_5.Geometry)
point_on_curve = PointOnCurve(curve, parameter=0.5)
scale_nu_5 = ScaleNU(Geometry=pipe_2, Plane=area_3.Centroid, ScaleX=1, ScaleY=1, ScaleZ=Slider(1.3, range=1..1.5))  # -> flatten(Geometry), Transform
multiplication_9 = Multiplication(A=step_thickness_2, B=0.3)
extrude_3 = Extrude(Base=boundary_surfaces_3, Direction=expr("-x", unit_z_6))
circle = Circle(Plane=deconstruct_brep_2.Vertices, Radius=multiplication_5)
unit_z_7 = UnitZ(Factor=multiplication_9)
point_list = PointList(Points=point_on_curve, Size=Slider(10, range=0..10))

split_list = SplitList(List=deconstruct_brep.Faces, Index="16")  # -> ListA, ListB
deconstruct_brep_3 = DeconstructBrep(Brep=split_list.ListB)  # -> Faces, Edges, Vertices
join_curves = JoinCurves(Curves=deconstruct_brep_3.Edges, Preserve=False)
multiplication_10 = Multiplication(A=multiplication_3, B=0.5)
list_item_3 = ListItem(List=join_curves, Index=0, Wrap=True)  # -> Item, Item1
offset_curve_3 = OffsetCurve(Curve=list_item_3.Item, Distance=expr("-x", multiplication_10), Corners=1)
offset_curve_4 = OffsetCurve(Curve=list_item_3.Item1, Distance=multiplication_10, Corners=1)
pipe_4 = Pipe(Curve=[offset_curve_3, offset_curve_4], Radius=multiplication_10, Caps=0)
solid_difference_2 = SolidDifference(BrepsA=pipe_4, BrepsB=extrude_2)

solid_difference_3 = SolidDifference(BrepsA=extrude_3, BrepsB=pipe_3)
move_6 = Move(Geometry=fillet_distance_8, Motion=unit_z_7)  # -> Geometry, Transform
cull_index = CullIndex(List=point_on_curve, Indices=[1, 3, 5, 8, 11, 14, 17, 20, 25, 27, 29, 32, 35, 38, 41, 44], Wrap=True)
multiplication_11 = Multiplication(A=multiplication_9, B=Slider(4, range=0..10))
deconstruct_brep_4 = DeconstructBrep(Brep=solid_difference_3)  # -> Faces, Edges, Vertices
multiplication_12 = Multiplication(A=multiplication_3, B=0.5)
edges_from_points = EdgesFromPoints(Brep=extrude_2, Points=cull_index, Valence=1)  # -> Edges, Indices, Map
unit_z_8 = UnitZ(Factor=multiplication_11)
boundary_surfaces_4 = BoundarySurfaces(Edges=move_6.Geometry)
list_item_4 = ListItem(List=deconstruct_brep_4.Faces, Index=0, Wrap=True)
deconstruct_brep_5 = DeconstructBrep(Brep=move_6.Geometry)  # -> Faces, Edges, Vertices

curve_2 = Curve(deconstruct_brep_5.Edges)
point_on_curve_2 = PointOnCurve(curve_2, parameter=0)
point_list_2 = PointList(Points=point_on_curve_2, Size=Slider(10, range=0..10))

extrude_4 = Extrude(Base=boundary_surfaces_4, Direction=expr("-x", unit_z_8))
fillet_edge = FilletEdge(Shape=extrude_2, Blend=0, Metric=0, Edges=edges_from_points.Indices, Radii=multiplication_12)
deconstruct_brep_6 = DeconstructBrep(Brep=list_item_4)  # -> Faces, Edges, Vertices
cull_index_2 = CullIndex(List=deconstruct_brep_5.Edges, Indices=[1, 3, 5, 7, 9], Wrap=True)
circular_arc = CircularArc(deconstruct_brep_5.Edges)
number_slider_2 = Slider(3, range=1..10)
multiplication_13 = Multiplication(A=number_slider_2, B=Slider(0.7, range=0.1..0.9))
panel = Panel(deconstruct_brep_4.Edges)
unit_z_9 = UnitZ(Factor=multiplication_13)
multiplication_14 = Multiplication(A=step_thickness_2, B=Slider(0.6, range=0..1))
clean_tree = CleanTree(RemoveNulls=True, RemoveInvalid=True, RemoveEmpty=False, Tree=circular_arc)
deconstruct_arc = DeconstructArc(Arc=cull_index_2)  # -> BasePlane, Radius, Angle
deconstruct_brep_7 = DeconstructBrep(Brep=extrude_4)  # -> Faces, Edges, Vertices
deconstruct_brep_8 = DeconstructBrep(Brep=fillet_edge)  # -> Faces, Edges, Vertices
panel_2 = Panel(deconstruct_brep_5.Edges)

curve_3 = Curve(deconstruct_brep_7.Edges)
point_on_curve_3 = PointOnCurve(curve_3, parameter=0.5)
point_list_3 = PointList(Points=point_on_curve_3, Size=Slider(10, range=0..10))

list_item_5 = ListItem(List=deconstruct_brep_6.Edges, Index=0, Wrap=True)
list_item_6 = ListItem(List=deconstruct_brep_8.Faces, Index=Slider(17, range=0..49), Wrap=True)
unit_z_10 = UnitZ(Factor=number_slider_2)
circle_2 = Circle(Plane=deconstruct_arc.BasePlane, Radius=multiplication_14)
move_7 = Move(Geometry=circle_2, Motion=expr("-x", unit_z_9))  # -> Geometry, Transform
list_item_7 = ListItem(List=deconstruct_arc.Radius, Index=0, Wrap=True)
deconstruct_brep_9 = DeconstructBrep(Brep=list_item_6)  # -> Faces, Edges, Vertices
boundary_surfaces_5 = BoundarySurfaces(Edges=move_7.Geometry)
number = Number(list_item_7)
evaluate_curve = EvaluateCurve(Curve=list_item_5, Parameter=Slider(0, range=0..100))  # -> Point, Tangent, Angle
subtraction = Subtraction(A=number, B=multiplication_14)

curve_4 = Curve(deconstruct_brep_9.Edges)
point_on_curve_4 = PointOnCurve(curve_4, parameter=0.5)
point_list_4 = PointList(Points=point_on_curve_4, Size=Slider(10, range=0..10))

list_item_8 = ListItem(List=deconstruct_brep_9.Edges, Index=[8, 9, 10, 11], Wrap=True)
extrude_5 = Extrude(Base=boundary_surfaces_5, Direction=unit_z_10)
number_slider_3 = Slider(1.25, range=1..1.5)
cull_index_3 = CullIndex(List=point_on_curve_3, Indices=[1, 3, 5, 8, 11, 14, 17, 20], Wrap=True)
offset_curve_5 = OffsetCurve(Curve=move_6.Geometry, Distance=expr("-x", subtraction), Corners=1)
list_item_9 = ListItem(List=point_on_curve_3, Index=0, Wrap=True)  # -> Item, Item1, Item2
area_4 = Area(Geometry=extrude_5)  # -> Area, Centroid
multiplication_15 = Multiplication(A=multiplication_14, B=Slider(0.4, range=0..1))
deconstruct_arc_2 = DeconstructArc(Arc=list_item_8)  # -> BasePlane, Radius, Angle
edges_from_points_2 = EdgesFromPoints(Brep=extrude_4, Points=cull_index_3, Valence=1)  # -> Edges, Indices, Map
multiplication_16 = Multiplication(A=multiplication_3, B=0.5)
line = Line(StartPoint=list_item_9.Item, EndPoint=list_item_9.Item2)

curve_5 = Curve(deconstruct_brep_9.Edges)
point_on_curve_5 = PointOnCurve(curve_5, parameter=0)
point_list_5 = PointList(Points=point_on_curve_5, Size=Slider(10, range=0..10))

offset_curve_6 = OffsetCurve(Curve=offset_curve_5, Distance=multiplication_15, Corners=1)
list_item_10 = ListItem(List=point_on_curve_4, Index=[8, 9, 10, 11], Wrap=True)
curve_middle = CurveMiddle(Curve=line)
list_item_11 = ListItem(List=point_on_curve_3, Index=[0, 13], Wrap=True)
list_item_12 = ListItem(List=point_on_curve, Index=[26, 39], Wrap=True)
scale_nu_6 = ScaleNU(
    Geometry=extrude_5,
    Plane=area_4.Centroid,
    ScaleX=number_slider_3,
    ScaleY=number_slider_3,
    ScaleZ=Slider(10, range=0..10))  # -> Geometry, Transform
offset_curve_7 = OffsetCurve(Curve=offset_curve_6, Distance=multiplication_15, Corners=1)
line_2 = Line(StartPoint=deconstruct_arc_2.BasePlane, EndPoint=list_item_10)

deconstruct_brep_10 = DeconstructBrep(Brep=extrude_5)  # -> Faces, Edges, Vertices
list_item_13 = ListItem(List=deconstruct_brep_10.Edges, Index=2, Wrap=True)
divide_curve = DivideCurve(Curve=list_item_13, Count=4, Kinks=False)  # -> Points, Tangents, Parameters
list_item_14 = ListItem(List=divide_curve.Points, Index=0, Wrap=True)  # -> Item, Item1, Item2, Item3
area_5 = Area(Geometry=list_item_13)  # -> Area, Centroid
line_3 = Line(StartPoint=list_item_14.Item1, EndPoint=list_item_14.Item3)
line_4 = Line(StartPoint=list_item_14.Item, EndPoint=list_item_14.Item2)
scale = Scale(Geometry=[line_4, line_3], Center=area_5.Centroid, Factor=Slider(0.7, range=0..1))  # -> Geometry, Transform
length_3 = Length(Curve=scale.Geometry)  # -> flatten(Length)
flip_matrix = FlipMatrix(Data=scale.Geometry)
list_item_15 = ListItem(List=length_3, Index=0, Wrap=True)
multiplication_17 = Multiplication(A=list_item_15, B=0.08)
multiplication_18 = Multiplication(A=list_item_15, B=0.15)
divide_curve_2 = DivideCurve(Curve=flip_matrix, Count=Slider(2, range=0..10), Kinks=False)  # -> Points, Tangents, Parameters
merge = Merge(Data1=multiplication_17, Data2=multiplication_18, Data3=multiplication_17)
pipe_variable = PipeVariable(Curve=flip_matrix, Parameters=divide_curve_2.Parameters, Radii=merge, Caps=2)  # -> flatten(Pipe)
solid_union = SolidUnion(Breps=pipe_variable)

fillet_edge_2 = FilletEdge(Shape=extrude_4, Blend=0, Metric=0, Edges=edges_from_points_2.Indices, Radii=multiplication_16)
deconstruct_brep_11 = DeconstructBrep(Brep=offset_curve_6)  # -> Faces, Edges, Vertices
deconstruct = Deconstruct(Point=list_item_12)  # -> XComponent, YComponent, ZComponent
deconstruct_2 = Deconstruct(Point=list_item_11)  # -> XComponent, YComponent, ZComponent
deconstruct_3 = Deconstruct(Point=curve_middle)  # -> XComponent, YComponent, ZComponent
multiplication_19 = Multiplication(A=deconstruct_arc_2.Radius, B=Slider(0.4, range=0.1..0.5))
point_on_curve_6 = PointOnCurve(line_2, parameter=0.337)
boundary_surfaces_6 = BoundarySurfaces(Edges=offset_curve_6)
cull_index_4 = CullIndex(List=deconstruct_brep_11.Edges, Indices=[3, 7], Wrap=True)
list_item_16 = ListItem(List=point_on_curve_5, Index=[5, 8, 4, 12], Wrap=True)
circle_3 = Circle(Plane=point_on_curve_6, Radius=multiplication_19)
list_item_17 = ListItem(List=point_on_curve_5, Index=[6, 10, 1, 14], Wrap=True)
subtraction_2 = Subtraction(A=deconstruct_3.ZComponent, B=deconstruct_2.ZComponent)
subtraction_3 = Subtraction(A=deconstruct_3.ZComponent, B=deconstruct.ZComponent)
number_slider_4 = Slider(8, range=5..10)

curve_6 = Curve(deconstruct_brep_11.Edges)
point_on_curve_7 = PointOnCurve(curve_6, parameter=0.5)
point_list_6 = PointList(Points=point_on_curve_7, Size=Slider(10, range=0..10))

unit_z_11 = UnitZ(Factor=subtraction_2)
polyline = PolyLine(Vertices=list_item_16, Closed=True)
polyline_2 = PolyLine(Vertices=list_item_17, Closed=True)
pipe_5 = Pipe(Curve=offset_curve_7, Radius=multiplication_15, Caps=2)
unit_z_12 = UnitZ(Factor=subtraction_3)
list_item_18 = ListItem(List=deconstruct_brep_11.Vertices, Index=1, Wrap=True)
list_item_19 = ListItem(List=deconstruct_brep_11.Edges, Index=7, Wrap=True)
move_8 = Move(Geometry=circle_3, Motion=expr("-x", unit_z_9))  # -> Geometry, Transform
area_6 = Area(Geometry=pipe_5)  # -> Area, Centroid
move_9 = Move(Geometry=list_item_11, Motion=unit_z_11)  # -> Geometry, Transform
vector = Vector(list_item_19)
move_10 = Move(Geometry=list_item_12, Motion=unit_z_12)  # -> Geometry, Transform
multiplication_20 = Multiplication(A=number_slider_4, B=0.5)
offset_curve_8 = OffsetCurve(Curve=[polyline, polyline_2], Distance=expr("-x", number_slider_4), Corners=1)
boundary_surfaces_7 = BoundarySurfaces(Edges=move_8.Geometry)
unit_z_13 = UnitZ(Factor=multiplication_20)
list_item_20 = ListItem(List=point_on_curve_7, Index=1, Wrap=True)
list_item_21 = ListItem(List=point_on_curve_7, Index=5, Wrap=True)
list_item_22 = ListItem(List=move_10.Geometry, Index=0, Wrap=True)  # -> Item, Item1
multiplication_21 = Multiplication(A=multiplication_19, B=Slider(1.35, range=1..1.5))
list_item_23 = ListItem(List=move_9.Geometry, Index=0, Wrap=True)  # -> Item, Item1
move_11 = Move(Geometry=offset_curve_8, Motion=unit_z_13)  # -> Geometry, Transform
scale_nu_7 = ScaleNU(Geometry=pipe_5, Plane=area_6.Centroid, ScaleX=1, ScaleY=1, ScaleZ=Slider(0.3, range=0..1))  # -> Geometry, Transform
point = Point(list_item_22.Item)
point_2 = Point(list_item_22.Item1)
point_3 = Point(list_item_23.Item)
point_4 = Point(list_item_23.Item1)
extrude_6 = Extrude(Base=boundary_surfaces_7, Direction=unit_z_10)
line_5 = Line(StartPoint=point_2, EndPoint=point_4)
line_6 = Line(StartPoint=point, EndPoint=point_3)
unit_z_14 = UnitZ(Factor=number_slider_4)
# 怎么更好的挑出来arc curve
# 就是，怎么从line type挑出来而不是全部list之后数是第几个
boundary_surfaces_8 = BoundarySurfaces(Edges=move_11.Geometry)
distance = Distance(PointA=list_item_20, PointB=list_item_21)
number_slider_5 = Slider(1.15, range=1..2)
number_slider_6 = Slider(90, range=0..100)
number_slider_7 = Slider(90, range=0..100)
area_7 = Area(Geometry=extrude_6)  # -> Area, Centroid
curve_middle_2 = CurveMiddle(Curve=line_6)
extrude_7 = Extrude(Base=boundary_surfaces_8, Direction=expr("-x", unit_z_14))
evaluate_length = EvaluateLength(Curve=line_5, Length=[0.1, 0.43, 0.57, 0.9], Normalized=True)  # -> Point, Tangent, Parameter
evaluate_length_2 = EvaluateLength(Curve=line_6, Length=[0.1, 0.43, 0.57, 0.9], Normalized=True)  # -> Point, Tangent, Parameter
division = Division(A=distance, B=ridge_number)
contour = Contour(Shape=boundary_surfaces_6, Point=list_item_18, Direction=vector, Distance=division)  # -> flatten(Contours)
curve_middle_3 = CurveMiddle(Curve=contour)
scale_2 = Scale(Geometry=contour, Center=curve_middle_3, Factor=Slider(0.985, range=0..1))  # -> Geometry, Transform
cull_index_5 = CullIndex(List=scale_2.Geometry, Indices=0, Wrap=True)
curve_middle_4 = CurveMiddle(Curve=line_5)
trim_with_regions = TrimWithRegions(Curve=cull_index_5, Regions=circle_2)  # -> Inside, Outside
division_2 = Division(A=division, B=Slider(3, range=0..10))
scale_nu_8 = ScaleNU(Geometry=extrude_6, Plane=area_7.Centroid, ScaleX=number_slider_5, ScaleY=number_slider_5, ScaleZ=1)  # -> Geometry, Transform
deconstruct_brep_12 = DeconstructBrep(Brep=extrude_7)  # -> Faces, Edges, Vertices
rotate = Rotate(Geometry=line_6, Angle=degrees(number_slider_6), Plane=curve_middle_2)  # -> Geometry, Transform
circle_4 = Circle(Plane=evaluate_length_2.Point, Radius=multiplication_21)
rotate_2 = Rotate(Geometry=line_5, Angle=degrees(number_slider_7), Plane=curve_middle_4)  # -> Geometry, Transform
circle_5 = Circle(Plane=evaluate_length.Point, Radius=multiplication_21)
pipe_6 = Pipe(Curve=trim_with_regions.Outside, Radius=division_2, Caps=2)

deconstruct_brep_13 = DeconstructBrep(Brep=extrude_6)  # -> Faces, Edges, Vertices
list_item_24 = ListItem(List=deconstruct_brep_13.Edges, Index=2, Wrap=True)
divide_curve_3 = DivideCurve(Curve=list_item_24, Count=4, Kinks=False)  # -> Points, Tangents, Parameters
list_item_25 = ListItem(List=divide_curve_3.Points, Index=0, Wrap=True)  # -> Item, Item1, Item2, Item3
area_8 = Area(Geometry=list_item_24)  # -> Area, Centroid
line_7 = Line(StartPoint=list_item_25.Item1, EndPoint=list_item_25.Item3)
line_8 = Line(StartPoint=list_item_25.Item, EndPoint=list_item_25.Item2)
scale_3 = Scale(Geometry=[line_8, line_7], Center=area_8.Centroid, Factor=Slider(0.7, range=0..1))  # -> Geometry, Transform
length_4 = Length(Curve=scale_3.Geometry)  # -> flatten(Length)
flip_matrix_2 = FlipMatrix(Data=scale_3.Geometry)
list_item_26 = ListItem(List=length_4, Index=0, Wrap=True)
multiplication_22 = Multiplication(A=list_item_26, B=0.08)
multiplication_23 = Multiplication(A=list_item_26, B=0.15)
divide_curve_4 = DivideCurve(Curve=flip_matrix_2, Count=Slider(2, range=0..10), Kinks=False)  # -> Points, Tangents, Parameters
merge_2 = Merge(Data1=multiplication_22, Data2=multiplication_23, Data3=multiplication_22)
pipe_variable_2 = PipeVariable(Curve=flip_matrix_2, Parameters=divide_curve_4.Parameters, Radii=merge_2, Caps=2)  # -> flatten(Pipe)
solid_union_2 = SolidUnion(Breps=pipe_variable_2)

number_slider_8 = Slider(1.5, range=0..10)

curve_7 = Curve(deconstruct_brep_12.Edges)
point_on_curve_8 = PointOnCurve(curve_7, parameter=0)
point_list_7 = PointList(Points=point_on_curve_8, Size=Slider(10, range=0..10))

solid_difference_4 = SolidDifference(BrepsA=fillet_edge, BrepsB=scale_nu_8.Geometry)
solid_difference_5 = SolidDifference(BrepsA=pipe_6, BrepsB=scale_nu_6.Geometry)
rotate_3d = Rotate3D(Geometry=circle_4, Angle=degrees(number_slider_6), Center=evaluate_length_2.Point, Axis=rotate.Geometry)  # -> Geometry, Transform
rotate_3d_2 = Rotate3D(Geometry=circle_5, Angle=degrees(number_slider_7), Center=evaluate_length.Point, Axis=rotate_2.Geometry)  # -> Geometry, Transform
multiplication_24 = Multiplication(A=number_slider_4, B=Slider(0.4, range=0.1..0.5))
area_9 = Area(Geometry=extrude_5)  # -> Area, Centroid
solid_difference_6 = SolidDifference(BrepsA=fillet_edge_2, BrepsB=flatten(solid_difference_5))
boundary_surfaces_9 = BoundarySurfaces(Edges=rotate_3d.Geometry)
boundary_surfaces_10 = BoundarySurfaces(Edges=rotate_3d_2.Geometry)
scale_4 = Scale(Geometry=line_6, Center=curve_middle_2, Factor=number_slider_8)  # -> Geometry, Transform
scale_5 = Scale(Geometry=line_5, Center=curve_middle_4, Factor=number_slider_8)  # -> Geometry, Transform
edges_from_points_3 = EdgesFromPoints(Brep=extrude_7, Points=point_on_curve_8, Valence=1)  # -> Edges, Indices, Map
scale_nu_9 = ScaleNU(Geometry=extrude_5, Plane=area_9.Centroid, ScaleX=number_slider_5, ScaleY=number_slider_5, ScaleZ=1)  # -> Geometry, Transform
list_item_27 = ListItem(List=boundary_surfaces_10, Index=0, Wrap=True)  # -> Item, Item1, Item2, Item3
list_item_28 = ListItem(List=boundary_surfaces_9, Index=0, Wrap=True)  # -> Item, Item1, Item2, Item3
fillet_edge_3 = FilletEdge(Shape=extrude_7, Blend=0, Metric=0, Edges=edges_from_points_3.Indices, Radii=multiplication_24)  # -> flatten(Result)
solid_difference_7 = SolidDifference(BrepsA=solid_difference_6, BrepsB=scale_nu_9.Geometry)
loft = Loft(
    Curves=[list_item_27.Item, list_item_27.Item1],
    Options={Adjust=False, Closed=False, LoftEnds=0, LoftSimp=0, LoftType=0, Rebuild=10, Refit=0.01})
loft_2 = Loft(
    Curves=[list_item_27.Item2, list_item_27.Item3],
    Options={Adjust=False, Closed=False, LoftEnds=0, LoftSimp=0, LoftType=0, Rebuild=10, Refit=0.01})
loft_3 = Loft(
    Curves=[list_item_28.Item, list_item_28.Item1],
    Options={Adjust=False, Closed=False, LoftEnds=0, LoftSimp=0, LoftType=0, Rebuild=10, Refit=0.01})
loft_4 = Loft(
    Curves=[list_item_28.Item2, list_item_28.Item3],
    Options={Adjust=False, Closed=False, LoftEnds=0, LoftSimp=0, LoftType=0, Rebuild=10, Refit=0.01})
pipe_7 = Pipe(Curve=[scale_5.Geometry, scale_4.Geometry], Radius=2.5, Caps=1)  # -> flatten(Pipe)
solid_difference_8 = SolidDifference(BrepsA=solid_difference_4, BrepsB=fillet_edge_3)
brep_join = BrepJoin(Breps=[loft_3, boundary_surfaces_9, loft_4])  # -> Breps, Closed
brep_join_2 = BrepJoin(Breps=[loft, loft_2, boundary_surfaces_10])  # -> Breps, Closed
list_item_29 = ListItem(List=pipe_7, Index=0, Wrap=True)  # -> Item, Item1
solid_difference_9 = SolidDifference(BrepsA=scale_nu_5.Geometry, BrepsB=solid_difference_8)
vector_2 = Vector(rotate_2.Geometry)
solid_difference_10 = SolidDifference(BrepsA=brep_join_2.Breps, BrepsB=list_item_29.Item1)
solid_difference_11 = SolidDifference(BrepsA=brep_join.Breps, BrepsB=list_item_29.Item)
solid_difference_12 = SolidDifference(BrepsA=scale_nu_7.Geometry, BrepsB=solid_difference_7)
multiplication_25 = Multiplication(A=vector_2, B=screw_distance_scale)
solid_union_3 = SolidUnion(Breps=[solid_difference_9, solid_difference_8])

# ---- group: Result
move_12 = Move(Geometry=[solid_difference_11, solid_difference_10], Motion=expr("-X", multiplication_25))  # -> Geometry, Transform
move_13 = Move(Geometry=pipe_7, Motion=expr("-X", multiplication_25))  # -> Geometry, Transform
move_14 = Move(Geometry=[solid_difference_11, solid_difference_10], Motion=multiplication_25)  # -> Geometry, Transform
move_15 = Move(Geometry=pipe_7, Motion=multiplication_25)  # -> Geometry, Transform

# ----
solid_difference_13 = SolidDifference(BrepsA=solid_difference_7, BrepsB=move_13.Geometry)

# ---- group: Result
solid_union_4 = SolidUnion(Breps=flatten([solid_difference_13, solid_difference_12]))
solid_difference_14 = SolidDifference(BrepsA=extrude_6, BrepsB=solid_union_2)
solid_difference_15 = SolidDifference(BrepsA=solid_union_3, BrepsB=move_15.Geometry)
solid_difference_16 = SolidDifference(BrepsA=extrude_5, BrepsB=solid_union)

# ---- group: Baking
group = Group(Objects=[solid_difference_14, solid_difference_15, move_14.Geometry, move_12.Geometry, move_15.Geometry, move_13.Geometry, solid_difference_13, solid_difference_16, solid_union_4])
