# Grasshopper definition 0901.gh (Grasshopper 1.0.8)

panel = Panel("railing")
panel_2 = Panel("Panel")
panel_3 = Panel("testing with WASP")
panel_4 = Panel("existing structure")
panel_5 = Panel("modular structure_base geometry")

# ---- group: base geo
construct_point = ConstructPoint(XCoordinate=0, YCoordinate=0, ZCoordinate=0)
unit_z = UnitZ(Factor="2")
unit_y = UnitY(Factor="1")
move = Move(Geometry=construct_point, Motion=unit_z)  # -> Geometry, Transform
unit_y_2 = UnitY(Factor="2")
move_2 = Move(Geometry=move.Geometry, Motion=unit_y)  # -> Geometry, Transform
move_3 = Move(Geometry=move_2.Geometry, Motion=unit_y_2)  # -> Geometry, Transform
polyline = PolyLine(Vertices=[construct_point, move_2.Geometry, move_3.Geometry], Closed=False)

# ----
# The height of stairs, often referred to as the "rise," is typically designed to be comfortable and safe for users. The most common rise for residential stairs is between 7 to 7.75 inches (about 18 to 20 cm). For commercial or public buildings, the rise might be slightly lower, generally between 6 to 7 inches (about 15 to 18 cm), to accommodate a broader range of users and comply with accessibility standards.
# 
# The tread depth, or the horizontal part of the step, usually ranges from 10 to 11 inches (about 25 to 28 cm). Proper proportions between the rise and tread are crucial for comfort and safety, often following the "Rule of 17-18" which suggests that the total of one rise and one tread should be between 17 and 18 inches (43 to 46 cm).
panel_6 = Panel("modular structure_component_stair")
geometry = Geometry(<brep referenced from the Rhino model>)
geometry_2 = Geometry(<brep referenced from the Rhino model>)
geometry_3 = Geometry(<brep referenced from the Rhino model>)

# ----
# testing with Ai generated joint
panel_7 = Panel("10.5")
ghpython_script = GhPythonScript(width=panel_7, length="21", height="2", depth="2", cap=Toggle(True))  # -> create_sunmao
# ---------- ghpython_script: Python ----------
__author__ = "Administrator"
__version__ = "2024.08.26"

import rhinoscriptsyntax as rs
import math

def create_sunmao(width, length):
    column_distance = 21 # (you can adjust this value)
    beam_thickness = 3.2 # (you can adjust this value)
    column_thickness = 10.5 # (you can adjust this value)

    building = {
        'width': width,
        'length': length,
        'height': 0,
        'depth': 0,
        'cap': True
    }

    columns_count = int(length / column_distance)
    for i in range(columns_count):
        column = {
            'type': 'cylinder',
            'radius': column_thickness // 2,
            'height': width,
            'segments': 10,
            'cap': False
        }
        building['components'].append(column)

    beam_count = int(math.floor(width / beam_thickness))
    for i in range(beam_count):
        beam = {
            'type': 'line',
            'point1': (0, beam_thickness // 100, 0),
            'point2': (beam_thickness // 100, beam_thickness // 100, 0)
        }
        building['components'].append(beam)

    return building
# ---------- end ghpython_script ----------
geometry_4 = Geometry(ghpython_script)

deconstruct_brep = DeconstructBrep(Brep=geometry_3)  # -> Faces, Edges, Vertices
deconstruct_brep_2 = DeconstructBrep(Brep=geometry_2)  # -> Faces, Edges, Vertices
deconstruct_brep_3 = DeconstructBrep(Brep=geometry)  # -> Faces, Edges, Vertices
list_item = ListItem(List=deconstruct_brep_2.Faces, Index=1, Wrap=True)
list_item_2 = ListItem(List=deconstruct_brep_3.Faces, Index=3, Wrap=True)
panel_8 = Panel(deconstruct_brep.Faces)

series = Series(Start=0, Step="0.18", Count="12")
series_2 = Series(Start=0, Step="0.25", Count="12")
unit_z_2 = UnitZ(Factor=series)
unit_y_3 = UnitY(Factor=series_2)
move_4 = Move(Geometry=construct_point, Motion=[unit_y_3, unit_z_2])  # -> Geometry, Transform

deconstruct_brep_4 = DeconstructBrep(Brep=list_item_2)  # -> Faces, Edges, Vertices
deconstruct_brep_5 = DeconstructBrep(Brep=list_item)  # -> Faces, Edges, Vertices
cull_index = CullIndex(List=deconstruct_brep.Faces, Indices="2", Wrap=True)
list_item_3 = ListItem(List=deconstruct_brep_5.Edges, Index=-1, Wrap=True)
list_item_4 = ListItem(List=deconstruct_brep_4.Edges, Index=-1, Wrap=True)
cull_index_2 = CullIndex(List=cull_index, Indices="3", Wrap=True)
panel_9 = Panel(cull_index_2)
project = Project(Geometry=list_item_4, Plane=list_item)  # -> Geometry, Transform
loft = Loft(
    Curves=[project.Geometry, list_item_4],
    Options={Adjust=False, Closed=False, LoftEnds=0, LoftSimp=0, LoftType=0, Rebuild=10, Refit=0.01})
move_to_plane = MoveToPlane(Geometry=list_item_3, Plane=loft, Above=True, Below=True)  # -> Geometry, Transform
divide_domain² = DivideDomain²(Domain=cull_index_2, UCount="2", VCount=Slider(3, range=0..10))
isotrim = Isotrim(Surface=graft(cull_index_2), Domain=divide_domain²)
rectangular = Rectangular(Plane=loft, SizeX="1.2", SizeY="1.2", ExtentX="20", ExtentY="20")  # -> Cells, Points
move_to_plane_2 = MoveToPlane(Geometry=move_to_plane.Geometry, Plane=list_item_2, Above=True, Below=True)  # -> Geometry, Transform
unit_x = UnitX(Factor=1)
area = Area(Geometry=isotrim)  # -> Area, Centroid
geometry_5 = Geometry(graft(rectangular.Cells))

number_slider = Slider(7, range=0..100)
series_3 = Series(Start="-4", Step="1", Count=number_slider)
unit_z_3 = UnitZ(Factor=series_3)
move_5 = Move(Geometry=geometry_5, Motion=unit_z_3)  # -> flatten(Geometry), Transform

line_sdl = LineSDL(Start=area.Centroid, Direction=unit_x, Length=Slider(0.4, range=0..1))
loft_2 = Loft(
    Curves=[move_to_plane_2.Geometry, move_to_plane.Geometry],
    Options={Adjust=False, Closed=False, LoftEnds=0, LoftSimp=0, LoftType=0, Rebuild=10, Refit=0.01})
conndir = Wasp_ConnectionFromDirection(GEO=geometry_3, CEN=area.Centroid, UP=line_sdl)  # -> CONN, PLN_OUT; inputs CEN: list of Point3d, UP: list of Curve, T: list; plug-in component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
unit_z_4 = UnitZ(Factor="-10")
part = Wasp_BasicPart(NAME="STICK", GEO=geometry_3, CONN=flatten(conndir.CONN))  # -> PART; inputs GEO: Mesh, CONN: list, COLL: Mesh, ATTR: list; plug-in component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
unit_z_5 = UnitZ(Factor="20")
move_6 = Move(Geometry=loft_2, Motion=unit_z_4)  # -> Geometry, Transform
extrude = Extrude(Base=move_6.Geometry, Direction=unit_z_5)
shape_in_brep = ShapeInBrep(Brep=extrude, Shape=move_5.Geometry)
larger_than = LargerThan(FirstNumber=shape_in_brep, SecondNumber="1")  # -> LargerThan, OrEqualTo
construct_point_2 = ConstructPoint(XCoordinate=0, YCoordinate=0, ZCoordinate=0)
construct_point_3 = ConstructPoint(XCoordinate=-1.4, YCoordinate=0, ZCoordinate=1.5)
vector_2pt = Vector2Pt(PointA=construct_point_2, PointB=construct_point_3, Unitize=False)  # -> Vector, Length
dispatch = Dispatch(List=move_5.Geometry, DispatchPattern=larger_than.OrEqualTo)  # -> ListA, ListB
series_4 = Series(Start=0, Step=4, Count=4)
geometry_6 = Geometry(dispatch.ListB)
deconstruct_brep_6 = DeconstructBrep(Brep=geometry_6)  # -> Faces, Edges, Vertices
list_length = ListLength(List=geometry_6)
list_item_5 = ListItem(List=deconstruct_brep_6.Edges, Index=series_4, Wrap=True)  # -> graft(Item)
unit_z_6 = UnitZ(Factor=1)
panel_10 = Panel(list_length)
angle = Angle(VectorA=unit_z_6, VectorB=list_item_5)  # -> Angle, Reflex
geometry_7 = Geometry()
addition = Addition(A=number_slider, B=1)
panel_11 = Panel(number_slider)
random_reduce = RandomReduce(List=geometry_6, Reduction="460", Seed="10")

perp_frames = PerpFrames(Curve=geometry_7, Count=1, Align=True)  # -> Frames, Parameters
polygon = Polygon(Plane=perp_frames.Frames, Radius="0.04", Segments="4", FilletRadius=0)  # -> Polygon, Length
sweep1 = Sweep1(Sections=polygon.Polygon, Miter=1)
cap_holes = CapHoles(Brep=sweep1)
deconstruct_brep_7 = DeconstructBrep(Brep=cap_holes)  # -> Faces, Edges, Vertices
list_item_6 = ListItem(List=deconstruct_brep_7.Faces, Index=4, Wrap=True)
list_item_7 = ListItem(List=deconstruct_brep_7.Edges, Index=4, Wrap=True)
geometry_8 = Geometry(list_item_7)
length = Length(Curve=geometry_8)
division = Division(A=length, B="3")
multiplication = Multiplication(A=division, B="2")
construct_domain² = ConstructDomain²(UMin="0", UMax="1", VMin=multiplication, VMax=length)
construct_domain²_2 = ConstructDomain²(UMin="0", UMax="1", VMin="0", VMax=division)
isotrim_2 = Isotrim(Surface=list_item_6, Domain=construct_domain²_2)
isotrim_3 = Isotrim(Surface=list_item_6, Domain=construct_domain²)
list_item_8 = ListItem(List=deconstruct_brep_7.Edges, Index=0, Wrap=True)
list_item_9 = ListItem(List=deconstruct_brep_7.Edges, Index=9, Wrap=True)
geometry_9 = Geometry(list_item_9)
sweep1_2 = Sweep1(Rail=list_item_8, Sections=isotrim_3, Miter=1)
sweep1_3 = Sweep1(Rail=list_item_8, Sections=isotrim_2, Miter=1)
geometry_10 = Geometry(sweep1_2)
geometry_11 = Geometry(sweep1_3)
cap_holes_2 = CapHoles(Brep=geometry_10)
cap_holes_3 = CapHoles(Brep=geometry_11)
geometry_12 = Geometry(cap_holes_2)
geometry_13 = Geometry(cap_holes_3)

geometry_14 = Geometry(geometry_6)
area_2 = Area(Geometry=geometry_6)  # -> Area, Centroid
geometry_15 = Geometry(<curve referenced from the Rhino model>)
geometry_16 = Geometry(<brep referenced from the Rhino model>)
deconstruct = Deconstruct(Point=area_2.Centroid)  # -> XComponent, YComponent, ZComponent
division_2 = Division(A=list_length, B=addition)
sort_list = SortList(Keys=deconstruct.ZComponent, ValuesValuesA=area_2.Centroid)  # -> Keys, ValuesValuesA
surface_closest_point = SurfaceClosestPoint(Point=area_2.Centroid, Surface=geometry_16)  # -> Point, UVPoint, Distance
geometry_17 = Geometry(sort_list.ValuesValuesA)
partition_list = PartitionList(List=geometry_17, Size=[3, 2])
construct_domain = ConstructDomain(DomainStart="0", DomainEnd=division_2)
sort_list_2 = SortList(Keys=surface_closest_point.Distance, ValuesValuesA=area_2.Centroid)  # -> Keys, ValuesValuesA
sub_list = SubList(List=sort_list_2.ValuesValuesA, Domain=construct_domain, Wrap=True)  # -> List, Index
cull_index_3 = CullIndex(List=sub_list.List, Indices=division_2, Wrap=True)
unit_z_7 = UnitZ(Factor=1)
geometry_18 = Geometry(cull_index_3)
panel_12 = Panel("""1
0
0
0
0
0
0""")
deconstruct_2 = Deconstruct(Point=geometry_18)  # -> XComponent, YComponent, ZComponent
sort_list_3 = SortList(Keys=deconstruct_2.ZComponent, ValuesValuesA=geometry_18)  # -> Keys, ValuesValuesA
multiplication_2 = Multiplication(A="1.2", B="1.2")
multiplication_3 = Multiplication(A="1.2", B="1.2")
addition_2 = Addition(A=multiplication_3, B=multiplication_2)
geometry_19 = Geometry(sort_list_3.ValuesValuesA)
square_root = SquareRoot(Value=addition_2)
division_3 = Division(A=square_root, B=2)
partition_list_2 = PartitionList(List=geometry_19, Size="10")
geometry_20 = Geometry(partition_list_2)

geometry_21 = Geometry(random_reduce)
area_3 = Area(Geometry=geometry_21)  # -> Area, Centroid
geometry_22 = Geometry(geometry_20)
distance = Distance(PointA=graft(area_3.Centroid), PointB=area_3.Centroid)
sort_list_4 = SortList(Keys=distance)  # -> reverse(Keys), ValuesValuesA
list_item_10 = ListItem(List=sort_list_4.Keys, Index=0, Wrap=True)
equality = Equality(FirstNumber=distance, SecondNumber=list_item_10)  # -> Equality, Inequality
panel_13 = Panel(list_item_10)
cull_pattern = CullPattern(List=area_3.Centroid, CullPattern=equality.Equality)
geometry_23 = Geometry(flatten(cull_pattern))

sort_list_5 = SortList(Keys=geometry_23, ValuesValuesA=geometry_23)  # -> Keys, ValuesValuesA
cull_pattern_2 = CullPattern(List=sort_list_5.ValuesValuesA, CullPattern=panel_12)
geometry_24 = Geometry(cull_pattern_2)
set_difference = SetDifference(SetA=area_3.Centroid, SetB=flatten(geometry_24))
move_7 = Move(Geometry=set_difference, Motion=unit_z_7)  # -> Geometry, Transform
line = Line(StartPoint=move_7.Geometry, EndPoint=set_difference)
perp_frames_2 = PerpFrames(Curve=line, Count=1, Align=False)  # -> Frames, Parameters
polygon_2 = Polygon(Plane=perp_frames_2.Frames, Radius=division_3, Segments=4, FilletRadius=0)  # -> Polygon, Length
rotate = Rotate(Geometry=polygon_2.Polygon, Angle=degrees("45"), Plane=perp_frames_2.Frames)  # -> Geometry, Transform
deconstruct_3 = Deconstruct(Point=geometry_20)  # -> XComponent, YComponent, ZComponent
boundary_surfaces = BoundarySurfaces(Edges=rotate.Geometry)
unit_z_8 = UnitZ(Factor=-1)
sort_list_6 = SortList(Keys=deconstruct_3.XComponent, ValuesValuesA=geometry_20)  # -> Keys, ValuesValuesA
move_8 = Move(Geometry=boundary_surfaces, Motion=unit_z_8)  # -> Geometry, Transform
extrude_2 = Extrude(Base=move_8.Geometry, Direction=vector_2pt.Vector)
geometry_25 = Geometry(extrude_2)
deconstruct_brep_8 = DeconstructBrep(Brep=geometry_25)  # -> Faces, Edges, Vertices

extrude_3 = Extrude(Base=geometry_25, Direction=vector_2pt.Vector)
deconstruct_brep_9 = DeconstructBrep(Brep=extrude_3)  # -> Faces, Edges, Vertices
curve_closest_point = CurveClosestPoint(Point=construct_point_2, Curve=deconstruct_brep_9.Edges)  # -> Point, Parameter, Distance
line_2 = Line(StartPoint=curve_closest_point.Point, EndPoint=construct_point_2)
length_2 = Length(Curve=line_2)
construct_domain_2 = ConstructDomain(DomainStart="0.06", DomainEnd="0.02")
bounds = Bounds(Numbers=length_2)
remap_numbers = RemapNumbers(Value=length_2, Source=bounds, Target=construct_domain_2)  # -> Mapped, Clipped
panel_14 = Panel(remap_numbers.Mapped)
pipe = Pipe(Curve=deconstruct_brep_9.Edges, Radius=remap_numbers.Mapped, Caps=2)
boundary_surfaces_2 = BoundarySurfaces(Edges=deconstruct_brep_9.Faces)
geometry_26 = Geometry(pipe)

geometry_27 = Geometry(deconstruct_brep_9.Faces)
sub_list_2 = SubList(List=deconstruct_brep_8.Faces, Domain="1 to 4", Wrap=True)  # -> List, Index
geometry_28 = Geometry(sub_list_2.List)
list_item_11 = ListItem(List=geometry_28, Index=2, Wrap=True)  # -> flatten(Item)
random_reduce_2 = RandomReduce(List=list_item_11, Reduction="30", Seed=1)
deconstruct_domain² = DeconstructDomain²(Domain=random_reduce_2)  # -> UMin, UMax, VMin, VMax
deconstruct_domain²_2 = DeconstructDomain²(Domain=random_reduce_2)  # -> UMin, UMax, VMin, VMax
panel_15 = Panel(random_reduce_2)
deconstruct_domain²_3 = DeconstructDomain²(Domain=random_reduce_2)  # -> UMin, UMax, VMin, VMax
division_4 = Division(A=deconstruct_domain².UMax, B="8")
subtraction = Subtraction(A=deconstruct_domain².UMax, B=division_4)
division_5 = Division(A=deconstruct_domain².VMax, B="8")
subtraction_2 = Subtraction(A=deconstruct_domain².VMax, B=division_5)
division_6 = Division(A=deconstruct_domain²_2.UMax, B="8")
subtraction_3 = Subtraction(A=deconstruct_domain²_2.UMax, B=division_6)
division_7 = Division(A=deconstruct_domain²_2.VMax, B="8")
subtraction_4 = Subtraction(A=deconstruct_domain²_2.VMax, B=division_7)
division_8 = Division(A=deconstruct_domain²_3.UMax, B="8")
subtraction_5 = Subtraction(A=deconstruct_domain²_3.UMax, B=division_8)
division_9 = Division(A=deconstruct_domain²_3.VMax, B="8")
subtraction_6 = Subtraction(A=deconstruct_domain²_3.VMax, B=division_9)
construct_domain_3 = ConstructDomain(DomainStart=division_4, DomainEnd=subtraction)
construct_domain_4 = ConstructDomain(DomainStart=division_6, DomainEnd=subtraction_3)
construct_domain_5 = ConstructDomain(DomainStart=division_5, DomainEnd=subtraction_2)
construct_domain_6 = ConstructDomain(DomainStart=division_7, DomainEnd=subtraction_4)
construct_domain_7 = ConstructDomain(DomainStart=division_8, DomainEnd=subtraction_5)
construct_domain_8 = ConstructDomain(DomainStart=division_9, DomainEnd=subtraction_6)
construct_domain²_3 = ConstructDomain²(DomainU=construct_domain_3, DomainV=construct_domain_5)
construct_domain²_4 = ConstructDomain²(DomainU=construct_domain_4, DomainV=construct_domain_6)
construct_domain²_5 = ConstructDomain²(DomainU=construct_domain_7, DomainV=construct_domain_8)
isotrim_4 = Isotrim(Surface=random_reduce_2, Domain=construct_domain²_3)
isotrim_5 = Isotrim(Surface=random_reduce_2, Domain=construct_domain²_4)
isotrim_6 = Isotrim(Surface=random_reduce_2, Domain=construct_domain²_5)
deconstruct_domain²_4 = DeconstructDomain²(Domain=isotrim_5)  # -> UMin, UMax, VMin, VMax
deconstruct_domain²_5 = DeconstructDomain²(Domain=isotrim_6)  # -> UMin, UMax, VMin, VMax
construct_domain_9 = ConstructDomain(DomainStart=0, DomainEnd=expr("x/3", deconstruct_domain²_4.VMax))
construct_domain_10 = ConstructDomain(DomainStart=0, DomainEnd=expr("x/3", deconstruct_domain²_5.VMax))
solid_difference = SolidDifference(BrepsA=random_reduce_2, BrepsB=isotrim_4)
construct_domain_11 = ConstructDomain(DomainStart=0, DomainEnd=deconstruct_domain²_4.UMax)
construct_domain_12 = ConstructDomain(DomainStart=0, DomainEnd=deconstruct_domain²_5.UMax)
construct_domain²_6 = ConstructDomain²(DomainU=construct_domain_11, DomainV=construct_domain_9)
construct_domain²_7 = ConstructDomain²(DomainU=construct_domain_12, DomainV=construct_domain_10)
geometry_29 = Geometry(solid_difference)
unit_x_2 = UnitX(Factor="0.04")
isotrim_7 = Isotrim(Surface=isotrim_5, Domain=construct_domain²_6)
isotrim_8 = Isotrim(Surface=isotrim_6, Domain=construct_domain²_7)
extrude_4 = Extrude(Base=geometry_29, Direction=unit_x_2)
deconstruct_domain²_6 = DeconstructDomain²(Domain=isotrim_8)  # -> UMin, UMax, VMin, VMax
division_10 = Division(A=deconstruct_domain²_6.UMax, B=12)
construct_domain_13 = ConstructDomain(DomainStart=0, DomainEnd=expr("x/3", 1))
construct_domain_14 = ConstructDomain(DomainStart=division_10, DomainEnd=0.5)
solid_difference_2 = SolidDifference(BrepsA=random_reduce_2, BrepsB=isotrim_7)
construct_domain²_8 = ConstructDomain²(DomainU=construct_domain_14, DomainV=construct_domain_13)
isotrim_9 = Isotrim(Surface=isotrim_8, Domain=construct_domain²_8)
geometry_30 = Geometry(solid_difference_2)
unit_x_3 = UnitX(Factor="0.04")
deconstruct_brep_10 = DeconstructBrep(Brep=isotrim_8)  # -> Faces, Edges, Vertices
extrude_5 = Extrude(Base=geometry_30, Direction=unit_x_3)
list_item_12 = ListItem(List=deconstruct_brep_10.Edges, Index=2, Wrap=True)
series_5 = Series(Start=0, Step=0.4, Count=4)
geometry_31 = Geometry(list_item_12)
end_points = EndPoints(Curve=geometry_31)  # -> Start, End
vector_2pt_2 = Vector2Pt(PointA=end_points.End, PointB=end_points.Start, Unitize=False)  # -> Vector, Length
vector = Vector(vector_2pt_2.Vector)
amplitude = Amplitude(Vector=vector, Amplitude=series_5)
panel_16 = Panel(series_5)
move_9 = Move(Geometry=isotrim_9, Motion=amplitude)  # -> Geometry, Transform
geometry_32 = Geometry(move_9.Geometry)
geometry_33 = Geometry(random_reduce_2)
solid_difference_3 = SolidDifference(BrepsA=geometry_33, BrepsB=geometry_32)
geometry_34 = Geometry(solid_difference_3)
unit_x_4 = UnitX(Factor="0.04")
extrude_6 = Extrude(Base=geometry_34, Direction=unit_x_4)
