# Grasshopper definition Week 5.gh (Grasshopper 1.0.8)

triangular = Triangular(Plane=PlaneXY(0, 0, 0), Size=1, ExtentX=Slider(10, range=0..10), ExtentY=Slider(10, range=0..10))  # -> Cells, Points
number_slider = Slider(30, range=0..100)
flatten_tree = FlattenTree(Tree=triangular.Cells, Path="{0}")
rectangle = Rectangle(Plane=PlaneXY(0, 0, 0), XSize=number_slider, YSize=number_slider, Radius=0)  # -> Rectangle, Length
unit_x = UnitX(Factor=number_slider)
explode = Explode(Curve=flatten_tree, Recursive=True)  # -> Segments, Vertices
area = Area(Geometry=flatten_tree)  # -> Area, Centroid
move = Move(Geometry=rectangle.Rectangle, Motion=unit_x)  # -> Geometry, Transform
evaluate_length = EvaluateLength(Curve=explode.Segments, Length=Slider(0.5, range=0..1), Normalized=True)  # -> Point, Tangent, Parameter
graft_tree = GraftTree(Tree=area.Centroid, IncludeEmptyLists=True, IncludeNullItems=True)
box_rectangle = BoxRectangle(Rectangle=move.Geometry, Height=number_slider)
point = Point([Point(1.785677256, 0.7923279681, 0), Point(4.373059315, 6.564534861, 0)])
number_slider_2 = Slider(2, range=1..3)
populate_3d = Populate3D(Region=box_rectangle, Count=Slider(100, range=0..100), Seed=1)
distance = Distance(PointA=graft_tree, PointB=point)
line = Line(StartPoint=evaluate_length.Point, EndPoint=graft_tree)
construct_domain = ConstructDomain(DomainStart=Slider(0, range=0..1), DomainEnd=Slider(1, range=0..1))

# ---- group: Same as math addition
point_2 = Point([<point referenced from the Rhino model> x2])
distance_2 = Distance(PointA=graft_tree, PointB=point_2)
construct_domain_2 = ConstructDomain(DomainStart=Slider(0.05, range=0..1), DomainEnd=Slider(0.95, range=0..1))
average = Average(Input=distance_2)
flatten_tree_2 = FlattenTree(Tree=average, Path="{0}")
bounds = Bounds(Numbers=flatten_tree_2)
remap_numbers = RemapNumbers(Value=average, Source=bounds, Target=construct_domain_2)  # -> Mapped, Clipped

# ----
construct_domain_3 = ConstructDomain(DomainStart=Slider(2, range=0..10), DomainEnd=Slider(10, range=0..10))
point_3 = Point(Point(4.373059315, 6.564534861, 0))
center_box = CenterBox(Base=populate_3d, X=number_slider_2, Y=number_slider_2, Z=number_slider_2)
distance_3 = Distance(PointA=graft_tree, PointB=point_3)
remap_numbers_2 = RemapNumbers(Value=distance, Source=construct_domain_3, Target=construct_domain)  # -> Mapped, Clipped
construct_domain_4 = ConstructDomain(DomainStart=Slider(0.05, range=0..1), DomainEnd=Slider(0.95, range=0..1))
mass_addition = MassAddition(Input=distance_3)  # -> Result, PartialResults
flatten_tree_3 = FlattenTree(Tree=mass_addition.Result, Path="{0}")
shape_in_brep = ShapeInBrep(Brep=center_box, Shape=box_rectangle)
boolean = Boolean(remap_numbers_2.Clipped)
dispatch = Dispatch(List=remap_numbers_2.Clipped, DispatchPattern=boolean)  # -> ListA, ListB

# ---- group: simple way
sort_list = SortList(Keys=remap_numbers_2.Clipped)  # -> Keys, ValuesA
list_item = ListItem(List=sort_list.Keys, Index=0, Wrap=True)  # -> Item, Item1
construct_domain_5 = ConstructDomain(DomainStart=Slider(0.123, range=0..1), DomainEnd=Slider(0.829, range=0..1))
remap_numbers_3 = RemapNumbers(Value=list_item.Item1, Source=Domain(0, 1), Target=construct_domain_5)  # -> Mapped, Clipped
list_item_2 = ListItem(List=remap_numbers_3.Mapped, Index=0, Wrap=True)
graph_mapper = GraphMapper(
    list_item_2,
    x0=0,
    x1=1,
    y0=0,
    y1=1,
    container_name="Bezier",
    cpx=[0, 0.3926133215, 0.5596286654, 1],
    cpy=[0, 0.1230733991, 1, 1])

# ----
bounds_2 = Bounds(Numbers=flatten_tree_3)
deconstruct_brep = DeconstructBrep(Brep=center_box)  # -> Faces, Edges, Vertices
larger_than = LargerThan(FirstNumber=shape_in_brep, SecondNumber=Slider(2, range=0..10))  # -> LargerThan, OrEqualTo
sort_list_2 = SortList(Keys=dispatch.ListA)  # -> reverse(Keys), ValuesA
remap_numbers_4 = RemapNumbers(Value=mass_addition.Result, Source=bounds_2, Target=construct_domain_4)  # -> Mapped, Clipped
trim_with_brep = TrimWithBrep(Curve=deconstruct_brep.Edges, Brep=box_rectangle)  # -> Inside, Outside
unit_z = UnitZ(Factor=Slider(0.125, range=0..1))
list_item_3 = ListItem(List=sort_list_2.Keys, Index=0, Wrap=True)
point_4 = Point(explode.Vertices)
integer = Integer("0")
dispatch_2 = Dispatch(List=center_box, DispatchPattern=larger_than.OrEqualTo)  # -> ListA, ListB
cull_pattern = CullPattern(List=center_box, CullPattern=larger_than.OrEqualTo)
construct_domain_6 = ConstructDomain(DomainStart=Slider(0.123, range=0..1), DomainEnd=Slider(0.829, range=0..1))
replace_nulls = ReplaceNulls(Items=list_item_3, Replacements=integer)  # -> Items, Count
curve = Curve(trim_with_brep.Inside)
panel = Panel(mass_addition.Result)
panel_2 = Panel(list_item_3)
remap_numbers_5 = RemapNumbers(Value=replace_nulls.Items, Source=Domain(0, 1), Target=construct_domain_6)  # -> Mapped, Clipped
brep = Brep(dispatch_2.ListA)
move_2 = Move(Geometry=graft_tree, Motion=unit_z)  # -> Geometry, Transform
list_item_4 = ListItem(List=remap_numbers_5.Mapped, Index=0, Wrap=True)
panel_3 = Panel(replace_nulls.Items)
graph_mapper_2 = GraphMapper(
    list_item_4,
    x0=0,
    x1=1,
    y0=0,
    y1=1,
    container_name="Bezier",
    cpx=[0, 0.3926133215, 0.5596286654, 1],
    cpy=[0, 0.1230733991, 1, 1])
evaluate_length_2 = EvaluateLength(Curve=line, Length=graph_mapper_2, Normalized=True)  # -> Point, Tangent, Parameter
weave = Weave(Pattern=[0, 1], Stream0=point_4, Stream1=evaluate_length_2.Point, NullGaps=False)
polyline = PolyLine(Vertices=weave, Closed=False)
panel_4 = Panel(list_item_4)
extrude_point = ExtrudePoint(Base=polyline, Point=move_2.Geometry)
panel_5 = Panel(graph_mapper_2)
