# Grasshopper definition joint new.gh (Grasshopper 1.0.8)

curve = Curve([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])
multiple_curves = MultipleCurves(Curves=curve)  # -> Points, IndexA, IndexB, ParamA, ParamB
end_points = EndPoints(Curve=curve)  # -> graft(Start), graft(End)
point = Point(simplify([end_points.End, end_points.Start]))
point_2 = Point(multiple_curves.Points)
cull_duplicates = CullDuplicates(Points=point_2, Tolerance=0.1, CullMode=3)  # -> Points, Indices, Valence
sphere_radius = Slider(150, range=150..500)
point_3 = Point(cull_duplicates.Points)
closest_points = ClosestPoints(Point=point_3, Cloud=point, Count=Slider(2, range=0..10))  # -> ClosestPoint, CPIndex, Distance
sphere = Sphere(Base=point_3, Radius=sphere_radius)
list_item = ListItem(List=reverse(closest_points.ClosestPoint), Index=0, Wrap=True)  # -> flatten(Item)
line = Line(StartPoint=point_3, EndPoint=list_item)
evaluate_length = EvaluateLength(Curve=line, Length=sphere_radius, Normalized=invert(True))  # -> Point, Tangent, Parameter
gene_pool = GenePool(Decimals=2, Maximum=1, Minimum=0.8, Value=[0.9, 0.85, 0.92, 0.89, 0.96, 0.91])
line_2 = Line(StartPoint=point_3, EndPoint=evaluate_length.Point)
number = Number(sphere_radius)
number_2 = Number(gene_pool)
perp_frame = PerpFrame(Curve=reparameterize(line_2), Parameter=number_2)
construct_domain = ConstructDomain(DomainStart=expr("-x", number), DomainEnd=number)
plane_surface = PlaneSurface(Plane=perp_frame, XSize=construct_domain, YSize=construct_domain)
sleeve_radius = Slider(35, range=25..250)
boundary_volume = BoundaryVolume(Boundaries=flatten([plane_surface, sphere]))
plane = Plane(perp_frame)
polygon = Polygon(Plane=plane, Radius=sleeve_radius, Segments=6, FilletRadius=0)  # -> Polygon, Length
custom_preview = CustomPreview(Geometry=boundary_volume, Material=ColourSwatch(SwatchColor=RGBA(200, 185, 191, 169)))
sleeve_length = Slider(50, range=20..250)
conic_length = Slider(140, range=20..250)
conic_length_2 = Slider(140, range=20..250)
vector = Vector(plane)
surface = Surface(polygon.Polygon)
pipe_radius = Slider(100, range=25..250)
multiplication = Multiplication(A=vector, B=sleeve_length)
multiplication_2 = Multiplication(A=vector, B=conic_length)
conic_radius_end = Slider(50, range=25..250)
multiplication_3 = Multiplication(A=vector, B=conic_length_2)
extrude = Extrude(Base=surface, Direction=multiplication)
move = Move(Geometry=plane, Motion=multiplication_2)  # -> Geometry, Transform
pipe_radius_2 = Slider(75, range=25..250)
move_2 = Move(Geometry=plane, Motion=multiplication)  # -> Geometry, Transform
conic_radius_end_2 = Slider(40, range=25..250)
move_3 = Move(Geometry=plane, Motion=multiplication_3)  # -> Geometry, Transform
polygon_2 = Polygon(Plane=move_2.Geometry, Radius=conic_radius_end, Segments=6, FilletRadius=0)  # -> simplify(graft(Polygon)), Length
polygon_3 = Polygon(Plane=move.Geometry, Radius=pipe_radius, Segments=6, FilletRadius=0)  # -> simplify(graft(Polygon)), Length
custom_preview_2 = CustomPreview(Geometry=extrude, Material=ColourSwatch(SwatchColor=RGBA(175, 177, 191, 169)))
circle = Circle(Plane=move_2.Geometry, Radius=conic_radius_end_2)  # -> simplify(graft(Circle))
circle_2 = Circle(Plane=move_3.Geometry, Radius=pipe_radius_2)  # -> simplify(graft(Circle))
area = Area(Geometry=polygon_3.Polygon)  # -> Area, Centroid
curve_2 = Curve([polygon_2.Polygon, polygon_3.Polygon])
curve_3 = Curve([circle, circle_2])
point_4 = Point(circle_2)
loft = Loft(Curves=curve_2, Options={Adjust=False, Closed=False, LoftEnds=0, LoftSimp=0, LoftType=0, Rebuild=10, Refit=0.01})
loft_2 = Loft(Curves=curve_3, Options={Adjust=False, Closed=False, LoftEnds=0, LoftSimp=0, LoftType=0, Rebuild=10, Refit=0.01})
line_3 = Line(StartPoint=flatten(point_4), EndPoint=list_item)
line_4 = Line(StartPoint=flatten(area.Centroid), EndPoint=list_item)
cap_holes = CapHoles(Brep=loft)
cap_holes_2 = CapHoles(Brep=loft_2)
extrude_along = ExtrudeAlong(Base=flatten(polygon_3.Polygon), Curve=line_4)
brep_edges = BrepEdges(Brep=cap_holes)  # -> Naked, Interior, NonManifold
brep_edges_2 = BrepEdges(Brep=cap_holes_2)  # -> Naked, Interior, NonManifold
pipe = Pipe(Curve=line_3, Radius=pipe_radius_2, Caps=0)
custom_preview_3 = CustomPreview(Geometry=cap_holes, Material=ColourSwatch(SwatchColor=RGBA(242, 191, 31, 95)))
custom_preview_4 = CustomPreview(Geometry=cap_holes_2, Material=ColourSwatch(SwatchColor=RGBA(242, 191, 31, 95)))
custom_preview_5 = CustomPreview(Geometry=extrude_along, Material=ColourSwatch(SwatchColor=RGBA(86, 116, 151, 95)))
custom_preview_6 = CustomPreview(Geometry=pipe, Material=ColourSwatch(SwatchColor=RGBA(86, 116, 151, 95)))
camera = Point(Point(650.0162979, -1848.123887, 1821.999158))
curve_4 = Curve(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)
brep = Brep(flatten([boundary_volume, extrude, cap_holes_2, pipe]))
make2d_perspective_view = Make2DPerspectiveView(Camera=camera, Frame=curve_4)
make2d = Make2D(Geometry=brep, View=make2d_perspective_view, TangentEdges=False, TangentSeams=False, AutoComputeMake2D=False)  # -> VisibleCurves, VisibleIndex, VisibleType, HiddenCurves, HiddenIndex, HiddenType
curve_5 = Curve(make2d.VisibleCurves)
curve_6 = Curve(make2d.HiddenCurves)
