# Grasshopper definition large grid.gh (Grasshopper 1.0.8)

curve = Curve([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])
curve_2 = Curve([<curve referenced from the Rhino model> x5])
curve_3 = Curve([<curve referenced from the Rhino model> x2])
curve_4 = Curve([<curve referenced from the Rhino model> x2184])
multiple_curves = MultipleCurves(Curves=curve)  # -> Points, IndexA, IndexB, ParamA, ParamB
number_slider = Slider(20, range=0..100)
end_points = EndPoints(Curve=curve)  # -> graft(Start), graft(End)
length = Length(Curve=curve_3)
multiple_curves_2 = MultipleCurves(Curves=curve_2)  # -> Points, IndexA, IndexB, ParamA, ParamB
end_points_2 = EndPoints(Curve=curve_2)  # -> graft(Start), graft(End)
multiple_curves_3 = MultipleCurves(Curves=curve_3)  # -> Points, IndexA, IndexB, ParamA, ParamB
number_slider_2 = Slider(15, range=0..100)
point = Point(simplify([end_points.End, end_points.Start]))
division = Division(A=length, B=Slider(150, range=0..1000))
point_2 = Point(multiple_curves.Points)
point_3 = Point(simplify([end_points_2.End, end_points_2.Start]))
point_4 = Point(multiple_curves_2.Points)
point_5 = Point(multiple_curves_3.Points)
cull_duplicates = CullDuplicates(Points=point_2, Tolerance=0.1, CullMode=3)  # -> Points, Indices, Valence
perp_frames = PerpFrames(Curve=curve_3, Count=number_slider, Align=True)  # -> Frames, Parameters
perp_frames_2 = PerpFrames(Curve=curve_3, Count=number_slider, Align=True)  # -> Frames, Parameters
cull_duplicates_2 = CullDuplicates(Points=point_4, Tolerance=0.1, CullMode=3)  # -> Points, Indices, Valence
perp_frames_3 = PerpFrames(Curve=curve_3, Count=division, Align=True)  # -> Frames, Parameters
sphere_radius = Slider(150, range=150..500)
cull_duplicates_3 = CullDuplicates(Points=point_5, Tolerance=0.1, CullMode=3)  # -> Points, Indices, Valence
sphere_radius_2 = Slider(150, range=150..500)
point_6 = Point(cull_duplicates.Points)
point_7 = Point(cull_duplicates_2.Points)
list_item = ListItem(List=perp_frames_3.Frames, Index=0, Wrap=True)  # -> Item1, Item
polygon = Polygon(Plane=perp_frames.Frames, Radius=Slider(60, range=0..1000), Segments=6, FilletRadius=0)  # -> Polygon, Length
point_8 = Point(cull_duplicates_3.Points)
polygon_2 = Polygon(Plane=perp_frames_2.Frames, Radius=number_slider_2, Segments=6, FilletRadius=0)  # -> Polygon, Length
closest_points = ClosestPoints(Point=point_6, Cloud=point, Count=Slider(2, range=0..10))  # -> ClosestPoint, CPIndex, Distance
closest_points_2 = ClosestPoints(Point=point_7, Cloud=point_3, Count=Slider(2, range=0..10))  # -> reverse(ClosestPoint), CPIndex, Distance
sphere = Sphere(Base=point_6, Radius=sphere_radius)
sphere_2 = Sphere(Base=point_8, Radius=Slider(80, range=0..100))
polygon_3 = Polygon(Plane=list_item.Item1, Radius=number_slider_2, Segments=6, FilletRadius=0)  # -> Polygon, Length
polygon_4 = Polygon(Plane=list_item.Item, Radius=number_slider_2, Segments=6, FilletRadius=0)  # -> Polygon, Length
sphere_3 = Sphere(Base=point_7, Radius=sphere_radius_2)
list_item_2 = ListItem(List=polygon.Polygon, Index=1, Wrap=True)
list_item_3 = ListItem(List=polygon.Polygon, Index=-2, Wrap=True)
list_item_4 = ListItem(List=polygon_2.Polygon, Index=0, Wrap=True)  # -> Item1, Item
list_item_5 = ListItem(List=reverse(closest_points.ClosestPoint), Index=0, Wrap=True)  # -> flatten(Item)
loft = Loft(
    Curves=[list_item_2, list_item_3],
    Options={Adjust=False, Closed=False, LoftEnds=0, LoftSimp=0, LoftType=0, Rebuild=10, Refit=0.01})
loft_2 = Loft(
    Curves=[list_item_4.Item1, list_item_3],
    Options={Adjust=False, Closed=False, LoftEnds=0, LoftSimp=0, LoftType=0, Rebuild=10, Refit=0.01})
loft_3 = Loft(
    Curves=[list_item_4.Item, list_item_2],
    Options={Adjust=False, Closed=False, LoftEnds=0, LoftSimp=0, LoftType=0, Rebuild=10, Refit=0.01})
line = Line(StartPoint=point_6, EndPoint=list_item_5)
line_2 = Line(StartPoint=point_7, EndPoint=closest_points_2.ClosestPoint)
brep_join = BrepJoin(Breps=[loft, loft_2, loft_3])  # -> Breps, Closed
evaluate_length = EvaluateLength(Curve=line, Length=sphere_radius, Normalized=invert(True))  # -> Point, Tangent, Parameter
evaluate_length_2 = EvaluateLength(Curve=line_2, Length=sphere_radius_2, Normalized=invert(True))  # -> Point, Tangent, Parameter
cap_holes = CapHoles(Brep=brep_join.Breps)
line_3 = Line(StartPoint=point_6, EndPoint=evaluate_length.Point)
line_4 = Line(StartPoint=point_7, EndPoint=evaluate_length_2.Point)
number = Number(sphere_radius)
number_2 = Number(sphere_radius_2)
perp_frame = PerpFrame(Curve=reparameterize(line_3), Parameter=Slider(0.9, range=0..1))
construct_domain = ConstructDomain(DomainStart=expr("-x", number), DomainEnd=number)
perp_frame_2 = PerpFrame(Curve=reparameterize(line_4), Parameter=Slider(0.9, range=0..1))
construct_domain_2 = ConstructDomain(DomainStart=expr("-x", number_2), DomainEnd=number_2)
plane_surface = PlaneSurface(Plane=perp_frame, XSize=construct_domain, YSize=construct_domain)
plane_surface_2 = PlaneSurface(Plane=perp_frame_2, XSize=construct_domain_2, YSize=construct_domain_2)
sleeve_radius = Slider(35, range=25..250)
sleeve_radius_2 = Slider(35, range=25..250)
boundary_volume = BoundaryVolume(Boundaries=flatten([plane_surface, sphere]))
boundary_volume_2 = BoundaryVolume(Boundaries=flatten([plane_surface_2, sphere_3]))
plane = Plane(perp_frame)
plane_2 = Plane(perp_frame_2)
polygon_5 = Polygon(Plane=plane, Radius=sleeve_radius, Segments=6, FilletRadius=0)  # -> Polygon, Length
polygon_6 = Polygon(Plane=plane_2, Radius=sleeve_radius_2, Segments=6, FilletRadius=0)  # -> Polygon, Length
sleeve_length = Slider(50, range=20..250)
sleeve_length_2 = Slider(50, range=20..250)
vector = Vector(plane)
conic_length = Slider(140, range=20..250)
vector_2 = Vector(plane_2)
conic_length_2 = Slider(140, range=20..250)
surface = Surface(polygon_5.Polygon)
surface_2 = Surface(polygon_6.Polygon)
multiplication = Multiplication(A=vector, B=sleeve_length)
multiplication_2 = Multiplication(A=vector_2, B=sleeve_length_2)
extrude = Extrude(Base=surface, Direction=multiplication)
pipe_radius = Slider(100, range=25..250)
multiplication_3 = Multiplication(A=vector, B=conic_length)
move = Move(Geometry=plane, Motion=multiplication)  # -> Geometry, Transform
extrude_2 = Extrude(Base=surface_2, Direction=multiplication_2)
conic_radius_end = Slider(50, range=25..250)
pipe_radius_2 = Slider(100, range=25..250)
multiplication_4 = Multiplication(A=vector_2, B=conic_length_2)
move_2 = Move(Geometry=plane_2, Motion=multiplication_2)  # -> Geometry, Transform
conic_radius_end_2 = Slider(50, range=25..250)
move_3 = Move(Geometry=plane, Motion=multiplication_3)  # -> Geometry, Transform
move_4 = Move(Geometry=plane_2, Motion=multiplication_4)  # -> Geometry, Transform
polygon_7 = Polygon(Plane=move.Geometry, Radius=conic_radius_end, Segments=6, FilletRadius=0)  # -> simplify(graft(Polygon)), Length
polygon_8 = Polygon(Plane=move_3.Geometry, Radius=pipe_radius, Segments=6, FilletRadius=0)  # -> simplify(graft(Polygon)), Length
polygon_9 = Polygon(Plane=move_2.Geometry, Radius=conic_radius_end_2, Segments=6, FilletRadius=0)  # -> simplify(graft(Polygon)), Length
polygon_10 = Polygon(Plane=move_4.Geometry, Radius=pipe_radius_2, Segments=6, FilletRadius=0)  # -> simplify(graft(Polygon)), Length
flatten_tree = FlattenTree(Tree=closest_points_2.ClosestPoint, Path="{0}")
area = Area(Geometry=polygon_8.Polygon)  # -> Area, Centroid
curve_5 = Curve([polygon_7.Polygon, polygon_8.Polygon])
area_2 = Area(Geometry=polygon_10.Polygon)  # -> Area, Centroid
curve_6 = Curve([polygon_9.Polygon, polygon_10.Polygon])
loft_4 = Loft(Curves=curve_5, Options={Adjust=False, Closed=False, LoftEnds=0, LoftSimp=0, LoftType=0, Rebuild=10, Refit=0.01})
loft_5 = Loft(Curves=curve_6, Options={Adjust=False, Closed=False, LoftEnds=0, LoftSimp=0, LoftType=0, Rebuild=10, Refit=0.01})
line_5 = Line(StartPoint=flatten(area.Centroid), EndPoint=list_item_5)
line_6 = Line(StartPoint=flatten(area_2.Centroid), EndPoint=flatten_tree)
cap_holes_2 = CapHoles(Brep=loft_4)
cap_holes_3 = CapHoles(Brep=loft_5)
extrude_along = ExtrudeAlong(Base=flatten(polygon_8.Polygon), Curve=line_5)
extrude_along_2 = ExtrudeAlong(Base=flatten(polygon_10.Polygon), Curve=line_6)
