# Grasshopper definition stair structure.gh (Grasshopper 1.0.8)
# plug-ins: PTComponentLibrary

number_slider = Slider(250, range=0..1000)
curve = Curve(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)
unit_z = UnitZ(Factor=Slider(250, range=0..1000))
move = Move(Geometry=curve, Motion=unit_z)  # -> Geometry, Transform

curve_2 = Curve(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)
end_points = EndPoints(Curve=curve_2)  # -> Start, End
end_points_2 = EndPoints(Curve=curve_2)  # -> Start, End
point = Point(simplify([end_points.End, end_points.Start]))
sphere_radius = Slider(150, range=150..500)
point_2 = Point(end_points_2.Start)
closest_points = ClosestPoints(Point=point_2, Cloud=point, Count=Slider(2, range=0..10))  # -> ClosestPoint, CPIndex, Distance
sphere = Sphere(Base=point_2, Radius=sphere_radius)
list_item = ListItem(List=reverse(closest_points.ClosestPoint), Index=0, Wrap=True)  # -> flatten(Item)
line = Line(StartPoint=point_2, EndPoint=list_item)
evaluate_length = EvaluateLength(Curve=line, Length=sphere_radius, Normalized=invert(True))  # -> Point, Tangent, Parameter
line_2 = Line(StartPoint=point_2, EndPoint=evaluate_length.Point)
number = Number(sphere_radius)
perp_frame = PerpFrame(Curve=reparameterize(line_2), Parameter=Slider(0.9, range=0..1))
construct_domain = ConstructDomain(DomainStart=expr("-x", number), DomainEnd=number)
plane_surface = PlaneSurface(Plane=perp_frame, XSize=construct_domain, YSize=construct_domain)
sleeve_radius = Slider(35, range=25..250)
boundary_volume = BoundaryVolume(Boundaries=flatten([plane_surface, sphere]))
plane = Plane(perp_frame)
polygon = Polygon(Plane=plane, Radius=sleeve_radius, Segments=6, FilletRadius=0)  # -> Polygon, Length
custom_preview = CustomPreview(Geometry=boundary_volume, Material=ColourSwatch(SwatchColor=RGBA(200, 185, 191, 169)))
sleeve_length = Slider(20, range=20..250)
vector = Vector(plane)
surface = Surface(polygon.Polygon)
multiplication = Multiplication(A=vector, B=sleeve_length)
conic_length = Slider(100, range=20..250)
extrude = Extrude(Base=surface, Direction=multiplication)
move_2 = Move(Geometry=plane, Motion=multiplication)  # -> Geometry, Transform
pipe_radius = Slider(100, range=25..250)
multiplication_2 = Multiplication(A=vector, B=conic_length)
custom_preview_2 = CustomPreview(Geometry=extrude, Material=ColourSwatch(SwatchColor=RGBA(175, 177, 191, 169)))
conic_radius_end = Slider(50, range=25..250)
move_3 = Move(Geometry=plane, Motion=multiplication_2)  # -> Geometry, Transform
polygon_2 = Polygon(Plane=move_2.Geometry, Radius=conic_radius_end, Segments=6, FilletRadius=0)  # -> simplify(graft(Polygon)), Length
polygon_3 = Polygon(Plane=move_3.Geometry, Radius=pipe_radius, Segments=6, FilletRadius=0)  # -> simplify(graft(Polygon)), Length
area = Area(Geometry=polygon_3.Polygon)  # -> Area, Centroid
curve_3 = Curve([polygon_2.Polygon, polygon_3.Polygon])
loft = Loft(Curves=curve_3, Options={Adjust=False, Closed=False, LoftEnds=0, LoftSimp=0, LoftType=0, Rebuild=10, Refit=0.01})
line_3 = Line(StartPoint=flatten(area.Centroid), EndPoint=list_item)
cap_holes = CapHoles(Brep=loft)
extrude_along = ExtrudeAlong(Base=flatten(polygon_3.Polygon), Curve=line_3)
custom_preview_3 = CustomPreview(Geometry=cap_holes, Material=ColourSwatch(SwatchColor=RGBA(242, 191, 31, 95)))
custom_preview_4 = CustomPreview(Geometry=extrude_along, Material=ColourSwatch(SwatchColor=RGBA(86, 116, 151, 95)))

unit_z_2 = UnitZ(Factor=number_slider)
curve_4 = Curve(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)

curve_5 = Curve(curve_4)
end_points_3 = EndPoints(Curve=curve_5)  # -> Start, End
end_points_4 = EndPoints(Curve=curve_5)  # -> Start, End
point_3 = Point(simplify([end_points_3.End, end_points_3.Start]))
sphere_radius_2 = Slider(150, range=150..500)
point_4 = Point(end_points_4.Start)
closest_points_2 = ClosestPoints(Point=point_4, Cloud=point_3, Count=Slider(2, range=0..10))  # -> ClosestPoint, CPIndex, Distance
sphere_2 = Sphere(Base=point_4, Radius=sphere_radius_2)
list_item_2 = ListItem(List=reverse(closest_points_2.ClosestPoint), Index=0, Wrap=True)  # -> flatten(Item)
line_4 = Line(StartPoint=point_4, EndPoint=list_item_2)
evaluate_length_2 = EvaluateLength(Curve=line_4, Length=sphere_radius_2, Normalized=invert(True))  # -> Point, Tangent, Parameter
line_5 = Line(StartPoint=point_4, EndPoint=evaluate_length_2.Point)
number_2 = Number(sphere_radius_2)
perp_frame_2 = PerpFrame(Curve=reparameterize(line_5), Parameter=Slider(0.9, range=0..1))
construct_domain_2 = ConstructDomain(DomainStart=expr("-x", number_2), DomainEnd=number_2)
plane_surface_2 = PlaneSurface(Plane=perp_frame_2, XSize=construct_domain_2, YSize=construct_domain_2)
sleeve_radius_2 = Slider(35, range=25..250)
boundary_volume_2 = BoundaryVolume(Boundaries=flatten([plane_surface_2, sphere_2]))
plane_2 = Plane(perp_frame_2)
polygon_4 = Polygon(Plane=plane_2, Radius=sleeve_radius_2, Segments=6, FilletRadius=0)  # -> Polygon, Length
custom_preview_5 = CustomPreview(Geometry=boundary_volume_2, Material=ColourSwatch(SwatchColor=RGBA(200, 185, 191, 169)))
sleeve_length_2 = Slider(50, range=20..250)
vector_2 = Vector(plane_2)
surface_2 = Surface(polygon_4.Polygon)
multiplication_3 = Multiplication(A=vector_2, B=sleeve_length_2)
conic_length_2 = Slider(140, range=20..250)
extrude_2 = Extrude(Base=surface_2, Direction=multiplication_3)
move_4 = Move(Geometry=plane_2, Motion=multiplication_3)  # -> Geometry, Transform
polygon_radius = Slider(100, range=25..250)
multiplication_4 = Multiplication(A=vector_2, B=conic_length_2)
custom_preview_6 = CustomPreview(Geometry=extrude_2, Material=ColourSwatch(SwatchColor=RGBA(175, 177, 191, 169)))
conic_radius_end_2 = Slider(50, range=25..250)
move_5 = Move(Geometry=plane_2, Motion=multiplication_4)  # -> Geometry, Transform
polygon_5 = Polygon(Plane=move_4.Geometry, Radius=conic_radius_end_2, Segments=6, FilletRadius=0)  # -> simplify(graft(Polygon)), Length
polygon_6 = Polygon(Plane=move_5.Geometry, Radius=polygon_radius, Segments=6, FilletRadius=0)  # -> simplify(graft(Polygon)), Length
area_2 = Area(Geometry=polygon_6.Polygon)  # -> Area, Centroid
curve_6 = Curve([polygon_5.Polygon, polygon_6.Polygon])
loft_2 = Loft(Curves=curve_6, Options={Adjust=False, Closed=False, LoftEnds=0, LoftSimp=0, LoftType=0, Rebuild=10, Refit=0.01})
line_6 = Line(StartPoint=flatten(area_2.Centroid), EndPoint=list_item_2)
cap_holes_2 = CapHoles(Brep=loft_2)
extrude_along_2 = ExtrudeAlong(Base=flatten(polygon_6.Polygon), Curve=line_6)
custom_preview_7 = CustomPreview(Geometry=cap_holes_2, Material=ColourSwatch(SwatchColor=RGBA(242, 191, 31, 95)))
custom_preview_8 = CustomPreview(Geometry=extrude_along_2, Material=ColourSwatch(SwatchColor=RGBA(86, 116, 151, 95)))

curve_7 = Curve(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)

curve_8 = Curve(curve_7)
end_points_5 = EndPoints(Curve=curve_8)  # -> Start, End
end_points_6 = EndPoints(Curve=curve_8)  # -> Start, End
point_5 = Point(simplify([end_points_5.End, end_points_5.Start]))
sphere_radius_3 = Slider(150, range=150..500)
point_6 = Point(end_points_6.Start)
closest_points_3 = ClosestPoints(Point=point_6, Cloud=point_5, Count=Slider(2, range=0..10))  # -> ClosestPoint, CPIndex, Distance
sphere_3 = Sphere(Base=point_6, Radius=sphere_radius_3)
list_item_3 = ListItem(List=reverse(closest_points_3.ClosestPoint), Index=0, Wrap=True)  # -> flatten(Item)
line_7 = Line(StartPoint=point_6, EndPoint=list_item_3)
evaluate_length_3 = EvaluateLength(Curve=line_7, Length=sphere_radius_3, Normalized=invert(True))  # -> Point, Tangent, Parameter
line_8 = Line(StartPoint=point_6, EndPoint=evaluate_length_3.Point)
number_3 = Number(sphere_radius_3)
perp_frame_3 = PerpFrame(Curve=reparameterize(line_8), Parameter=Slider(0.9, range=0..1))
construct_domain_3 = ConstructDomain(DomainStart=expr("-x", number_3), DomainEnd=number_3)
plane_surface_3 = PlaneSurface(Plane=perp_frame_3, XSize=construct_domain_3, YSize=construct_domain_3)
sleeve_radius_3 = Slider(35, range=25..250)
boundary_volume_3 = BoundaryVolume(Boundaries=flatten([plane_surface_3, sphere_3]))
plane_3 = Plane(perp_frame_3)
polygon_7 = Polygon(Plane=plane_3, Radius=sleeve_radius_3, Segments=6, FilletRadius=0)  # -> Polygon, Length
custom_preview_9 = CustomPreview(Geometry=boundary_volume_3, Material=ColourSwatch(SwatchColor=RGBA(200, 185, 191, 169)))
sleeve_length_3 = Slider(50, range=20..250)
vector_3 = Vector(plane_3)
surface_3 = Surface(polygon_7.Polygon)
multiplication_5 = Multiplication(A=vector_3, B=sleeve_length_3)
conic_length_3 = Slider(140, range=20..250)
extrude_3 = Extrude(Base=surface_3, Direction=multiplication_5)
move_6 = Move(Geometry=plane_3, Motion=multiplication_5)  # -> Geometry, Transform
pipe_radius_2 = Slider(100, range=25..250)
multiplication_6 = Multiplication(A=vector_3, B=conic_length_3)
custom_preview_10 = CustomPreview(Geometry=extrude_3, Material=ColourSwatch(SwatchColor=RGBA(175, 177, 191, 169)))
conic_radius_end_3 = Slider(50, range=25..250)
move_7 = Move(Geometry=plane_3, Motion=multiplication_6)  # -> Geometry, Transform
polygon_8 = Polygon(Plane=move_6.Geometry, Radius=conic_radius_end_3, Segments=6, FilletRadius=0)  # -> simplify(graft(Polygon)), Length
polygon_9 = Polygon(Plane=move_7.Geometry, Radius=pipe_radius_2, Segments=6, FilletRadius=0)  # -> simplify(graft(Polygon)), Length
area_3 = Area(Geometry=polygon_9.Polygon)  # -> Area, Centroid
curve_9 = Curve([polygon_8.Polygon, polygon_9.Polygon])
loft_3 = Loft(Curves=curve_9, Options={Adjust=False, Closed=False, LoftEnds=0, LoftSimp=0, LoftType=0, Rebuild=10, Refit=0.01})
line_9 = Line(StartPoint=flatten(area_3.Centroid), EndPoint=list_item_3)
cap_holes_3 = CapHoles(Brep=loft_3)
extrude_along_3 = ExtrudeAlong(Base=flatten(polygon_9.Polygon), Curve=line_9)
custom_preview_11 = CustomPreview(Geometry=cap_holes_3, Material=ColourSwatch(SwatchColor=RGBA(242, 191, 31, 95)))
custom_preview_12 = CustomPreview(Geometry=extrude_along_3, Material=ColourSwatch(SwatchColor=RGBA(86, 116, 151, 95)))

curve_10 = Curve(move.Geometry)
move_8 = Move(Geometry=curve_4, Motion=unit_z_2)  # -> Geometry, Transform
move_9 = Move(Geometry=curve_7, Motion=unit_z_2)  # -> Geometry, Transform
xy_plane = XYPlane(Origin=Point(0, 0, 0))
project = Project(Geometry=curve_10, Plane=xy_plane)  # -> Geometry, Transform
xy_plane_2 = XYPlane(Origin=Point(0, 0, 0))
xy_plane_3 = XYPlane(Origin=Point(0, 0, 0))
curve_middle = CurveMiddle(Curve=project.Geometry)
project_2 = Project(Geometry=move_8.Geometry, Plane=xy_plane_2)  # -> Geometry, Transform
project_3 = Project(Geometry=move_9.Geometry, Plane=xy_plane_3)  # -> Geometry, Transform
curve_middle_2 = CurveMiddle(Curve=project_3.Geometry)
rotate_3d = Rotate3D(Geometry=project_3.Geometry, Angle=degrees(Slider(90, range=0..100)), Center=curve_middle_2, Axis=Vector(0, 0, 1))  # -> Geometry, Transform
angle = Angle(VectorA=curve_10, VectorB=project.Geometry)  # -> Angle, Reflex
step_height = Slider(180, range=0..1000)
line_10 = Line(StartPoint=move_7.Geometry, EndPoint=end_points_5.End)
rotate_3d_2 = Rotate3D(Geometry=project.Geometry, Angle=degrees(Slider(90, range=0..100)), Center=curve_middle, Axis=Vector(0, 0, 1))  # -> Geometry, Transform
step_height_2 = Slider(180, range=0..1000)
step_height_3 = Slider(180, range=0..1000)
angle_2 = Angle(VectorA=move_8.Geometry, VectorB=project_2.Geometry)  # -> Angle, Reflex
right_trigonometry = RightTrigonometry(Alpha=angle.Angle, QLength=step_height)  # -> Alpha, Beta, PLength, QLength, RLength
angle_3 = Angle(VectorA=move_9.Geometry, VectorB=project_3.Geometry)  # -> Angle, Reflex
right_trigonometry_2 = RightTrigonometry(Alpha=angle_3.Angle, RLength=number_slider)  # -> Alpha, Beta, PLength, QLength, RLength
offset_curve = OffsetCurve(Curve=line_10, Distance=expr("-x", right_trigonometry_2.PLength), Corners=1)
number_slider_2 = Slider(40, range=0..100)
right_trigonometry_3 = RightTrigonometry(Alpha=angle_2.Angle, QLength=step_height_2)  # -> Alpha, Beta, PLength, QLength, RLength
right_trigonometry_4 = RightTrigonometry(Alpha=angle_3.Angle, QLength=step_height_3)  # -> Alpha, Beta, PLength, QLength, RLength
ruled_surface = RuledSurface(CurveA=line_10, CurveB=offset_curve)
negative = Negative(Value=right_trigonometry.PLength)
vector_4 = Vector(rotate_3d.Geometry)
divide_distance = DivideDistance(Curve=curve_10, Distance=right_trigonometry.RLength, AddEnd=True)
multiplication_7 = Multiplication(A=vector_4, B=number_slider_2)
multiplication_8 = Multiplication(A=negative, B=Slider(1.36, range=1..2))
negative_2 = Negative(Value=right_trigonometry_3.PLength)
negative_3 = Negative(Value=right_trigonometry_4.PLength)
cull_index = CullIndex(List=divide_distance, Indices=[0, -1], Wrap=True)  # -> simplify(graft(List))
divide_distance_2 = DivideDistance(Curve=move_8.Geometry, Distance=right_trigonometry_3.RLength, AddEnd=True)
divide_distance_3 = DivideDistance(Curve=move_9.Geometry, Distance=right_trigonometry_4.RLength, AddEnd=True)
extrude_4 = Extrude(Base=ruled_surface, Direction=expr("-x", multiplication_7))
integer = Integer(multiplication_8)
vector_5 = Vector(project.Geometry)
multiplication_9 = Multiplication(A=negative_2, B=Slider(1.36, range=1..2))
multiplication_10 = Multiplication(A=negative_3, B=Slider(1.36, range=1..2))
multiplication_11 = Multiplication(A=integer, B=vector_5)
cull_index_2 = CullIndex(List=divide_distance_2, Indices=[0, -1], Wrap=True)  # -> simplify(graft(List))
cull_index_3 = CullIndex(List=divide_distance_3, Indices=[0, -1], Wrap=True)  # -> simplify(graft(List))
solid_difference = SolidDifference(BrepsA=extrude_4, BrepsB=extrude_along_3)
integer_2 = Integer(multiplication_9)
move_10 = Move(Geometry=cull_index, Motion=multiplication_11)  # -> simplify(Geometry), Transform
integer_3 = Integer(multiplication_10)
vector_6 = Vector(project_2.Geometry)
vector_7 = Vector(project_3.Geometry)
vector_8 = Vector(curve_7)
multiplication_12 = Multiplication(A=integer_2, B=vector_6)
multiplication_13 = Multiplication(A=integer_3, B=vector_7)
multiplication_14 = Multiplication(A=vector_8, B=right_trigonometry_4.RLength)
move_11 = Move(Geometry=cull_index_2, Motion=multiplication_12)  # -> simplify(Geometry), Transform
move_12 = Move(Geometry=cull_index_3, Motion=multiplication_13)  # -> simplify(Geometry), Transform
multiplication_15 = Multiplication(A=Slider(0.3, range=0..1), B=multiplication_14)
multiplication_16 = Multiplication(A=Slider(0.5, range=0..1), B=multiplication_14)
multiplication_17 = Multiplication(A=Slider(0.22, range=0..1), B=multiplication_14)
multiplication_18 = Multiplication(A=Slider(0.58, range=0..1), B=multiplication_14)
polyline = PolyLine(Vertices=[move_10.Geometry, cull_index], Closed=False)
vector_9 = Vector(rotate_3d_2.Geometry)
multiplication_19 = Multiplication(A=Slider(1500, range=0..10000), B=vector_9)
move_13 = Move(Geometry=cull_index_3, Motion=expr("-x", multiplication_15))  # -> Geometry, Transform
move_14 = Move(Geometry=cull_index_3, Motion=expr("-x", multiplication_16))  # -> Geometry, Transform
move_15 = Move(Geometry=cull_index_3, Motion=expr("-x", multiplication_17))  # -> Geometry, Transform
move_16 = Move(Geometry=cull_index_3, Motion=expr("-x", multiplication_18))  # -> Geometry, Transform
end_points_7 = EndPoints(Curve=curve_7)  # -> Start, End
end_points_8 = EndPoints(Curve=curve_4)  # -> Start, End
polyline_2 = PolyLine(Vertices=[cull_index_2, move_11.Geometry], Closed=False)
negative_4 = Negative(Value=multiplication_19)
polyline_3 = PolyLine(Vertices=[move_12.Geometry, cull_index_3], Closed=False)
line_11 = Line(StartPoint=end_points_7.Start, EndPoint=end_points_8.Start)
multiplication_20 = Multiplication(A=multiplication_7, B=Slider(2.5, range=0..10))
move_17 = Move(Geometry=polyline, Motion=multiplication_19)  # -> Geometry, Transform
move_18 = Move(Geometry=polyline, Motion=negative_4)  # -> Geometry, Transform
flip_curve = FlipCurve(Curve=polyline_2)  # -> Curve, Flag
move_19 = Move(Geometry=move_15.Geometry, Motion=expr("-x", multiplication_7))  # -> Geometry, Transform
move_20 = Move(Geometry=move_16.Geometry, Motion=expr("-x", multiplication_7))  # -> Geometry, Transform
move_21 = Move(Geometry=move_13.Geometry, Motion=expr("-x", multiplication_20))  # -> Geometry, Transform
move_22 = Move(Geometry=move_14.Geometry, Motion=expr("-x", multiplication_20))  # -> Geometry, Transform
length = Length(Curve=line_11)
number_slider_3 = Slider(900, range=0..1000)
curve_middle_3 = CurveMiddle(Curve=move_18.Geometry)  # -> flatten(Midpoint)
curve_middle_4 = CurveMiddle(Curve=move_17.Geometry)  # -> flatten(Midpoint)
unit_z_3 = UnitZ(Factor=Slider(50, range=0..100))
multiplication_21 = Multiplication(A=number_slider_2, B=2)
loft_4 = Loft(
    Curves=[polyline_3, flip_curve.Curve],
    Options={Adjust=False, Closed=False, LoftEnds=0, LoftSimp=0, LoftType=0, Rebuild=10, Refit=0.01})
loft_5 = Loft(
    Curves=[move_17.Geometry, move_18.Geometry],
    Options={Adjust=False, Closed=False, LoftEnds=0, LoftSimp=0, LoftType=0, Rebuild=10, Refit=0.01})
unit_z_4 = UnitZ(Factor=Slider(45, range=0..100))
multiplication_22 = Multiplication(A=right_trigonometry.RLength, B=Slider(3, range=0..10))
subtraction = Subtraction(A=length, B=multiplication_21)
polyline_4 = PolyLine(Vertices=curve_middle_4, Closed=False)
polyline_5 = PolyLine(Vertices=curve_middle_3, Closed=False)
line_12 = Line(StartPoint=move_19.Geometry, EndPoint=move_20.Geometry)
vector_10 = Vector(rotate_3d.Geometry)
extrude_5 = Extrude(Base=loft_4, Direction=unit_z_3)
unit_z_5 = UnitZ(Factor=number_slider_3)
polyline_6 = PolyLine(
    Vertices=[move_15.Geometry, move_19.Geometry, move_21.Geometry, move_22.Geometry, move_20.Geometry, move_16.Geometry],
    Closed=True)
multiplication_23 = Multiplication(A=vector_10, B=subtraction)
extrude_6 = Extrude(Base=loft_5, Direction=unit_z_4)
number_slider_4 = Slider(0.95, range=0..1)
unit_z_6 = UnitZ(Factor=Slider(-100, range=-200..0))
offset_curve_2 = OffsetCurve(Curve=polyline_6, Distance=expr("-x", Slider(10, range=0..10)), Corners=1)
extrude_7 = Extrude(Base=line_12, Direction=expr("-x", multiplication_23))
number_slider_5 = Slider(0.3, range=0..1)
deconstruct_brep = DeconstructBrep(Brep=extrude_5)  # -> Faces, Edges, Vertices
move_23 = Move(Geometry=polyline_5, Motion=unit_z_5)  # -> Geometry, Transform
move_24 = Move(Geometry=polyline_4, Motion=unit_z_5)  # -> Geometry, Transform
move_25 = Move(Geometry=curve_10, Motion=unit_z_6)  # -> Geometry, Transform
list_item_4 = ListItem(List=deconstruct_brep.Edges, Index=2, Wrap=True)
number_slider_6 = Slider(1.17, range=1..1.5)
region_difference = RegionDifference(CurvesA=polyline_6, CurvesB=offset_curve_2)
offset_surface = OffsetSurface(Surface=extrude_7, Distance=Slider(30, range=0..100), Retrim=True)
vector_11 = Vector(curve_10)
multiplication_24 = Multiplication(A=right_trigonometry.RLength, B=number_slider_5)
multiplication_25 = Multiplication(A=negative_4, B=number_slider_4)
multiplication_26 = Multiplication(A=multiplication_19, B=number_slider_4)
list_item_5 = ListItem(List=deconstruct_brep.Faces, Index=4, Wrap=True)
point_on_curve = PointOnCurve(move_23.Geometry, parameter=0.75)
point_on_curve_2 = PointOnCurve(move_24.Geometry, parameter=0.75)
divide_distance_4 = DivideDistance(Curve=move_25.Geometry, Distance=right_trigonometry.RLength, AddEnd=True)
multiplication_27 = Multiplication(A=multiplication_24, B=vector_11)
perp_frames = PerpFrames(Curve=list_item_4, Count=Slider(2, range=0..10), Align=True)  # -> Frames, Parameters
deconstruct_brep_2 = DeconstructBrep(Brep=extrude_7)  # -> Faces, Edges, Vertices
deconstruct_brep_3 = DeconstructBrep(Brep=offset_surface)  # -> Faces, Edges, Vertices
move_26 = Move(Geometry=polyline, Motion=multiplication_25)  # -> Geometry, Transform
move_27 = Move(Geometry=polyline, Motion=multiplication_26)  # -> Geometry, Transform
boundary_surfaces = BoundarySurfaces(Edges=region_difference)
unit_z_7 = UnitZ(Factor=step_height_3)
cull_index_4 = CullIndex(List=divide_distance_4, Indices=[0, -1], Wrap=True)  # -> simplify(graft(List))
negative_5 = Negative(Value=multiplication_27)
scale = Scale(Geometry=move_24.Geometry, Center=point_on_curve_2, Factor=number_slider_6)  # -> Geometry, Transform
scale_2 = Scale(Geometry=move_23.Geometry, Center=point_on_curve, Factor=number_slider_6)  # -> Geometry, Transform
subtraction_2 = Subtraction(A=Slider(1, range=0..1), B=number_slider_5)
list_item_6 = ListItem(List=perp_frames.Frames, Index=1, Wrap=True)
join_curves = JoinCurves(Curves=deconstruct_brep_2.Edges, Preserve=False)
join_curves_2 = JoinCurves(Curves=deconstruct_brep_3.Edges, Preserve=False)
extrude_8 = Extrude(Base=boundary_surfaces, Direction=unit_z_7)
move_28 = Move(Geometry=cull_index_4, Motion=negative_5)  # -> Geometry, Transform
end_points_9 = EndPoints(Curve=polyline_4)  # -> Start, End
end_points_10 = EndPoints(Curve=scale.Geometry)  # -> Start, End
end_points_11 = EndPoints(Curve=polyline_5)  # -> Start, End
end_points_12 = EndPoints(Curve=scale_2.Geometry)  # -> Start, End
evaluate_curve = EvaluateCurve(Curve=move_17.Geometry, Parameter=subtraction_2)  # -> Point, Tangent, Angle
evaluate_curve_2 = EvaluateCurve(Curve=move_27.Geometry, Parameter=subtraction_2)  # -> Point, Tangent, Angle
evaluate_curve_3 = EvaluateCurve(Curve=move_26.Geometry, Parameter=subtraction_2)  # -> Point, Tangent, Angle
evaluate_curve_4 = EvaluateCurve(Curve=move_18.Geometry, Parameter=subtraction_2)  # -> Point, Tangent, Angle
loft_6 = Loft(
    Curves=[join_curves, join_curves_2],
    Options={Adjust=False, Closed=False, LoftEnds=0, LoftSimp=0, LoftType=0, Rebuild=10, Refit=0.01})
split_brep_multiple = SplitBrepMultiple(Brep=extrude_8, Cutters=extrude_5)
divide_length = DivideLength(Curve=polyline_5, Length=multiplication_22)  # -> Points, Tangents, Parameters
cap_holes_4 = CapHoles(Brep=loft_6)
divide_length_2 = DivideLength(Curve=polyline_4, Length=multiplication_22)  # -> Points, Tangents, Parameters
polyline_7 = PolyLine(Vertices=[end_points_9.Start, end_points_10.Start, end_points_10.End, end_points_9.End], Closed=False)
polyline_8 = PolyLine(Vertices=[end_points_11.Start, end_points_12.Start, end_points_12.End, end_points_11.End], Closed=False)
number_slider_7 = Slider(30, range=0..100)
subtraction_3 = Subtraction(A=number_slider_3, B=number_slider_7)
list_item_7 = ListItem(List=split_brep_multiple, Index=2, Wrap=True)
unit_z_8 = UnitZ(Factor=subtraction_3)
point_7 = Point([evaluate_curve.Point, evaluate_curve_2.Point, move_28.Geometry, evaluate_curve_3.Point, evaluate_curve_4.Point])

cap_holes_5 = CapHoles(Brep=list_item_7)
geometry = Geometry(solid_difference)

interpolate = Interpolate(Vertices=point_7, Degree=3, Periodic=False, KnotStyle=1)  # -> Curve, Length, Domain
move_29 = Move(Geometry=divide_length_2.Points, Motion=unit_z_8)  # -> Geometry, Transform
move_30 = Move(Geometry=divide_length.Points, Motion=unit_z_8)  # -> Geometry, Transform
number_slider_8 = Slider(30, range=0..100)
offset_curve_3 = OffsetCurve(Curve=polyline_7, Distance=expr("-x", number_slider_7), Corners=1)
offset_curve_4 = OffsetCurve(Curve=polyline_8, Distance=expr("-x", number_slider_7), Corners=1)
mirror = Mirror(Geometry=[cap_holes_5, geometry], Plane=list_item_6)  # -> Geometry, Transform
vector_12 = Vector(rotate_3d_2.Geometry)
unit_z_9 = UnitZ(Factor=Slider(80, range=0..150))
line_13 = Line(StartPoint=divide_length_2.Points, EndPoint=move_29.Geometry)
line_14 = Line(StartPoint=divide_length.Points, EndPoint=move_30.Geometry)
end_points_13 = EndPoints(Curve=offset_curve_3)  # -> Start, End
end_points_14 = EndPoints(Curve=polyline_7)  # -> Start, End
end_points_15 = EndPoints(Curve=offset_curve_4)  # -> Start, End
end_points_16 = EndPoints(Curve=polyline_8)  # -> Start, End
multiplication_28 = Multiplication(A=number_slider_8, B=vector_12)
move_31 = Move(Geometry=interpolate.Curve, Motion=expr("-x", unit_z_9))  # -> Geometry, Transform
move_32 = Move(Geometry=line_13, Motion=expr("-x", multiplication_28))  # -> Geometry, Transform
line_15 = Line(StartPoint=end_points_16.Start, EndPoint=end_points_15.Start)
line_16 = Line(StartPoint=end_points_14.Start, EndPoint=end_points_13.Start)
line_17 = Line(StartPoint=end_points_14.End, EndPoint=end_points_13.End)
line_18 = Line(StartPoint=end_points_16.End, EndPoint=end_points_15.End)
move_33 = Move(Geometry=line_14, Motion=multiplication_28)  # -> Geometry, Transform
group = Group(Objects=[extrude_along_3, cap_holes_3, extrude_3, boundary_volume_3])
unit_z_10 = UnitZ(Factor=Slider(40, range=0..100))
group_2 = Group(Objects=[extrude_along_2, cap_holes_2, extrude_2, boundary_volume_2])
number_slider_9 = Slider(70, range=0..100)
curve_middle_5 = CurveMiddle(Curve=move_31.Geometry)
join_curves_3 = JoinCurves(Curves=[polyline_7, line_16, offset_curve_3, line_17], Preserve=False)
join_curves_4 = JoinCurves(Curves=[polyline_8, line_15, offset_curve_4, line_18], Preserve=False)
vector_13 = Vector(rotate_3d_2.Geometry)
move_34 = Move(Geometry=move_25.Geometry, Motion=expr("-x", unit_z_10))  # -> Geometry, Transform
scale_nu = ScaleNU(Geometry=move_31.Geometry, Plane=curve_middle_5, ScaleX=1, ScaleY=1, ScaleZ=Slider(1.3, range=1..2))  # -> Geometry, Transform
multiplication_29 = Multiplication(A=number_slider_9, B=vector_13)
pipe = Pipe(Curve=[move_32.Geometry, move_33.Geometry], Radius=Slider(15, range=0..100), Caps=2)
multiplication_30 = Multiplication(A=multiplication_28, B=2)
boundary_surfaces_2 = BoundarySurfaces(Edges=join_curves_3)
subtraction_4 = Subtraction(A=number_slider_8, B=5)
vector_14 = Vector(rotate_3d_2.Geometry)
vector_15 = Vector(project.Geometry)
boundary_surfaces_3 = BoundarySurfaces(Edges=join_curves_4)
negative_6 = Negative(Value=multiplication_29)
move_35 = Move(Geometry=boundary_surfaces_3, Motion=multiplication_30)  # -> Geometry, Transform
loft_7 = Loft(
    Curves=[interpolate.Curve, scale_nu.Geometry],
    Options={Adjust=False, Closed=False, LoftEnds=0, LoftSimp=0, LoftType=0, Rebuild=10, Refit=0.01})
multiplication_31 = Multiplication(A=Slider(35, range=0..100), B=vector_15)
multiplication_32 = Multiplication(A=subtraction_4, B=vector_14)
move_36 = Move(Geometry=boundary_surfaces_2, Motion=expr("-x", multiplication_30))  # -> Geometry, Transform
move_37 = Move(Geometry=move_34.Geometry, Motion=multiplication_29)  # -> Geometry, Transform
move_38 = Move(Geometry=move_34.Geometry, Motion=negative_6)  # -> Geometry, Transform
multiplication_33 = Multiplication(A=number_slider_9, B=2)
extrude_9 = Extrude(Base=loft_7, Direction=multiplication_31)
deconstruct_brep_4 = DeconstructBrep(Brep=extrude_9)  # -> Faces, Edges, Vertices
curve_middle_6 = CurveMiddle(Curve=deconstruct_brep_4.Edges)
flip_matrix = FlipMatrix(Data=deconstruct_brep_4.Edges)
panel = Panel(flip_matrix)
list_item_8 = ListItem(List=deconstruct_brep_4.Edges, Index=0, Wrap=True)  # -> simplify(Item)
point_list = PointList(Points=curve_middle_6, Size=Slider(21, range=0..100))
list_item_9 = ListItem(List=flip_matrix, Index=0, Wrap=True)  # -> simplify(Item)
cull_index_5 = CullIndex(List=list_item_8, Indices=[1, 3, 7, 11], Wrap=True)
cull_index_6 = CullIndex(List=list_item_9, Indices=[1, 3, 7, 11], Wrap=True)
panel_2 = Panel(list_item_8)
curve_middle_7 = CurveMiddle(Curve=list_item_8)
edges_from_points = EdgesFromPoints(Brep=extrude_9, Points=curve_middle_7, Valence=1)  # -> Edges, Indices, Map
panel_3 = Panel(edges_from_points.Indices)
fillet_edge = FilletEdge(Shape=extrude_9, Blend=0, Metric=0, Edges=edges_from_points.Indices, Radii=Slider(7, range=0..10))
extrude_10 = Extrude(Base=boundary_surfaces_2, Direction=expr("-x", multiplication_32))
extrude_11 = Extrude(Base=move_35.Geometry, Direction=expr("-x", multiplication_32))
extrude_12 = Extrude(Base=move_36.Geometry, Direction=multiplication_32)
extrude_13 = Extrude(Base=boundary_surfaces_3, Direction=multiplication_32)
unit_z_11 = UnitZ(Factor=multiplication_33)
loft_8 = Loft(
    Curves=[move_37.Geometry, move_38.Geometry],
    Options={Adjust=False, Closed=False, LoftEnds=0, LoftSimp=0, LoftType=0, Rebuild=10, Refit=0.01})
solid_difference_2 = SolidDifference(BrepsA=extrude_9, BrepsB=extrude_along)
extrude_14 = Extrude(Base=loft_8, Direction=expr("-x", unit_z_11))
group_3 = Group(Objects=[extrude_13, extrude_11, extrude_12, extrude_10])
solid_difference_3 = SolidDifference(BrepsA=extrude_9, BrepsB=extrude_14)
